# Grasshopper definition FacadeAuthoring with hops.gh (Grasshopper 1.0.8)
# plug-ins: opennest_2 Info, Hops

# ----
# layout generator
number_slider = Slider(0.3, range=0..1)
xy_plane = XYPlane(Origin=Point(0, 0, 0))
python_3_script = Python3Script(
    face_plane=xy_plane,
    facade_w=Slider(600, range=0..1000),
    facade_h=Slider(420, range=0..1000),
    baseSize=Slider(30, range=0..100),
    sizes_text="1,2,3,5,8",
    seed=Slider(1, range=0..1),
    small_bias=number_slider)  # -> out, tile_planes, tile_w, tile_h, span, i_idx, j_idx, corner_id_suggest, rect_preview
# ---------- python_3_script: Python ----------
import random
from math import floor
import Rhino.Geometry as rg

# inputs:
# face_plane: rg.Plane
# facade_w, facade_h, baseSize: float (cm)
# sizes_text: str like "1,2,3,5,8"
# seed: int
# small_bias: 0..1

# outputs to define:
tile_planes, tile_w, tile_h, span, i_idx, j_idx = [], [], [], [], [], []
corner_id_suggest, rect_preview = [], []

# grid in base cells
nx = int(floor(facade_w / baseSize))
ny = int(floor(facade_h / baseSize))
if nx <= 0 or ny <= 0: 
    raise ValueError("facade size too small for baseSize")

# parse sizes, largest first
S = [int(s.strip()) for s in sizes_text.split(",") if s.strip().isdigit()]
S = sorted(set(S), reverse=True)
if not S: S = [1,2,3,5,8]
random.seed(int(seed))

used = [[False]*nx for _ in range(ny)]

def fits(i, j, s):
    if i + s > nx or j + s > ny: return False
    for jj in range(j, j+s):
        for ii in range(i, i+s):
            if used[jj][ii]: return False
    return True

def mark(i, j, s):
    for jj in range(j, j+s):
        for ii in range(i, i+s):
            used[jj][ii] = True

# scan top->bottom, left->right (Y first so visuals feel natural)
for j in range(ny):
    for i in range(nx):
        if used[j][i]: 
            continue
        chosen = None
        # choose largest that fits
        for s in S:
            if fits(i, j, s):
                chosen = s
                # smallness bias: sometimes step down to a smaller one that also fits
                idx = S.index(s)
                while random.random() < max(0.0, min(1.0, small_bias)) and idx < len(S)-1:
                    s2 = S[idx+1]
                    if fits(i, j, s2):
                        chosen = s2
                        idx += 1
                    else:
                        break
                break
        if chosen is None:
            # fallback: fill with 1 if possible
            if fits(i, j, 1): 
                chosen = 1
            else:
                continue

        mark(i, j, chosen)

        w = chosen * baseSize
        h = w
        # local center of this tile relative to face_plane origin (facade center)
        cx = -facade_w/2.0 + (i + chosen/2.0) * baseSize
        cy = -facade_h/2.0 + (j + chosen/2.0) * baseSize

        # plane at tile center, same axes as facade plane
        origin = face_plane.PointAt(cx, cy)
        tp = rg.Plane(origin, face_plane.XAxis, face_plane.YAxis)

        tile_planes.append(tp)
        tile_w.append(w); tile_h.append(h)
        span.append(chosen)
        i_idx.append(i); j_idx.append(j)

        # corner id suggestion for quarter‑rings so 2x2 blocks assemble circles
        # pattern by cell parity (works even when spans mix):
        # (even,even)->0, (odd,even)->1, (odd,odd)->2, (even,odd)->3
        cid = (i % 2) + 2 * (j % 2)
        corner_id_suggest.append(cid)

        # rectangle preview (in face_plane space)
        rx = rg.Interval(cx - w/2.0, cx + w/2.0)
        ry = rg.Interval(cy - h/2.0, cy + h/2.0)
        rect = rg.Rectangle3d(face_plane, rx, ry)
        rect_preview.append(rect.ToNurbsCurve())
# ---------- end python_3_script ----------

# ----
# tile context
python_3_script_2 = Python3Script(
    tile_planes=python_3_script.tile_planes,
    tile_w=python_3_script.tile_w,
    tile_h=python_3_script.tile_h,
    corner_id_suggest=python_3_script.corner_id_suggest)  # -> out, tile_ctx_json, count
# ---------- python_3_script_2: Python ----------
import json
import Rhino.Geometry as rg
import System.IO as IO

# ---------- helpers ----------
def flatten(xs):
    """Return a flat list. If xs is a single item (e.g., float), wrap it."""
    if xs is None:
        return []
    if not isinstance(xs, (list, tuple)):
        return [xs]
    out = []
    for x in xs:
        if isinstance(x, (list, tuple)):
            out.extend(flatten(x))
        else:
            out.append(x)
    return out

def mid(iv):
    try: return (iv.T0 + iv.T1) * 0.5
    except: return 0.5

def coerce_plane(obj):
    """Try to obtain a Plane from several geometry types."""
    # Plane
    if isinstance(obj, rg.Plane):
        return True, rg.Plane(obj)

    # Rectangle3d
    if isinstance(obj, rg.Rectangle3d):
        return True, rg.Plane(obj.Plane)

    # Planar curve
    if isinstance(obj, rg.Curve):
        ok, pl = obj.TryGetPlane(1e-6)
        if ok: return True, pl
        bb = obj.GetBoundingBox(True)
        if bb.IsValid:
            p = bb.Center
            return True, rg.Plane(p, rg.Vector3d.ZAxis)

    # Surface
    if isinstance(obj, rg.Surface):
        ok, pl = obj.TryGetPlane()
        if ok: return True, pl
        try:
            u = mid(obj.Domain(0)); v = mid(obj.Domain(1))
            ok, pl = obj.FrameAt(u, v)
            if ok: return True, pl
        except: pass

    # Brep (use first face)
    if isinstance(obj, rg.Brep) and obj.Faces.Count > 0:
        face = obj.Faces[0]
        ok, pl = face.TryGetPlane()
        if ok: return True, pl
        try:
            pt = face.PointAt(0.5, 0.5)
            n  = face.NormalAt(0.5, 0.5)
            if not n.IsZero:
                n.Unitize()
                return True, rg.Plane(pt, n)
        except: pass

    # Mesh: fit plane to vertices
    if isinstance(obj, rg.Mesh) and obj.Vertices.Count >= 3:
        pts = [rg.Point3d(v.X, v.Y, v.Z) for v in obj.Vertices]
        ok, pl = rg.Plane.FitPlaneToPoints(pts)
        if ok: return True, pl

    return False, None

def plane_to_dict(p):
    return {
        "origin":[p.OriginX, p.OriginY, p.OriginZ],
        "xaxis":[p.XAxis.X, p.XAxis.Y, p.XAxis.Z],
        "yaxis":[p.YAxis.X, p.YAxis.Y, p.YAxis.Z],
        "zaxis":[p.ZAxis.X, p.ZAxis.Y, p.ZAxis.Z]
    }

def as_list_num(xs, cast=float):
    return [cast(x) for x in flatten(xs)]

# ---------- read & sanitize inputs ----------
planes  = flatten(tile_planes)
ws      = as_list_num(tile_w, float)
hs      = as_list_num(tile_h, float)
corners = as_list_num(corner_id_suggest, int)

n = min(len(planes), len(ws), len(hs))
ctxs = []

for k in range(n):
    ok, pl = coerce_plane(planes[k])
    if not ok:
        # skip items we can't coerce to a plane
        continue

    corner = corners[k] if k < len(corners) else 0

    ctxs.append({
        "id": int(k),
        "plane": plane_to_dict(pl),
        "bbox_w": float(ws[k]),
        "bbox_h": float(hs[k]),
        "corner_id": int(corner)
    })

tile_ctx_json = json.dumps(ctxs, indent=2)
count = len(ctxs)

# ---------- optional save ----------
try:
    if save_path and str(save_path).strip():
        IO.File.WriteAllText(str(save_path), tile_ctx_json)
except Exception as e:
    # If you want to debug saving issues, uncomment:
    # print("Save error:", e)
    pass
# ---------- end python_3_script_2 ----------

# ----
# archetype + metrics
number_slider_2 = Slider(0, range=0..3)
hops = Hops(
    Face_plane=python_3_script.tile_planes,
    Tile_w=python_3_script.tile_w,
    Tile_h=python_3_script.tile_h,
    Archetype_id=number_slider_2,
    Frame_t=Slider(6, range=0..10),
    Bar_t=Slider(5, range=0..10),
    Ring_t=Slider(6, range=0..10),
    Corner_id=python_3_script.corner_id_suggest,
    Theta_deg=Slider(0, range=0..90),
    CacheResultsInMemory=True,
    CacheSolveResults=True,
    RemoteDefinitionLocation="C:\Users\user\Desktop\VS\RL_Voxel-Agent_PPO_V1\TileEvaluator.gh",
    RemoteSolveVersion=(0, 1, 0),
    ShowInput_Enabled=False,
    ShowInput_Path=False,
    SynchronousSolve=True)  # -> Metrics_json, Signature_raw, flatten(Preview_crv)

# ----
# archetype + metrics
number_slider_3 = Slider(0, range=0..3)
python_3_script_3 = Python3Script(
    face_plane=python_3_script.tile_planes,
    tile_w=python_3_script.tile_w,
    tile_h=python_3_script.tile_h,
    archetype_id=number_slider_3,
    frame_t=Slider(4, range=0..10),
    bar_t=Slider(3, range=0..10),
    ring_t=Slider(3, range=0..10),
    corner_id=python_3_script.corner_id_suggest,
    theta_deg=Slider(0, range=0..90))  # -> metrics_json, signature_raw, flatten(preview_crv)
# ---------- python_3_script_3: Python ----------
import math, json
import Rhino.Geometry as rg

# ---------- helpers ----------
def clamp(x, lo, hi): return max(lo, min(hi, x))
def rr(x, n): return round(float(x), n)

def valid_inputs(w,h,ft,bt,rt):
    if w is None or h is None:                return False, "missing size"
    if w <= 0 or h <= 0:                      return False, "non-positive size"
    if ft is None or bt is None or rt is None:return False, "missing thickness"
    if ft < 0 or bt < 0 or rt < 0:            return False, "negative thickness"
    if 2*ft >= min(w,h):                      return False, "frame too thick"
    return True, ""

def make_rect_xy(cx, cy, ww, hh):
    rx = rg.Interval(cx-ww/2.0, cx+ww/2.0)
    ry = rg.Interval(cy-hh/2.0, cy+hh/2.0)
    return rg.Rectangle3d(rg.Plane.WorldXY, rx, ry).ToNurbsCurve()

def xform_to_face(curves, face_plane, theta_deg):
    # rotate in local XY by theta, then orient XY->face_plane
    rot = rg.Transform.Rotation(math.radians(float(theta_deg)), rg.Point3d(0,0,0))
    xform = rg.Transform.PlaneToPlane(rg.Plane.WorldXY, face_plane)
    out=[]
    for c in curves:
        cc = c.DuplicateCurve()
        cc.Transform(rot); cc.Transform(xform)
        out.append(cc)
    return out

# ---------- read / sanitize inputs ----------
w   = float(tile_w)
h   = float(tile_h)
ft  = float(frame_t)
bt  = float(bar_t)
rt  = float(ring_t)
aid = int(archetype_id)
cid = int(corner_id) % 4
th  = float(theta_deg)

# defaults so outputs are always defined
preview = []
panel_area_m2 = 0.0
cut_length_m  = 0.0
void_ratio    = 1.0
is_valid      = False
signature_raw = ""

ok, msg = valid_inputs(w,h,ft,bt,rt)

if ok:
    # ---------- base numbers (cm) ----------
    outer_perim = 2.0*(w+h)
    inner_w = w - 2.0*ft
    inner_h = h - 2.0*ft
    inner_perim = 2.0*(inner_w + inner_h)
    rect_area = w*h
    built_area = 0.0
    ring_cut = 0.0

    # ---------- archetypes ----------
    if aid == 0:  # SOLID
        built_area = rect_area
        cut_len_cm = outer_perim
        preview += xform_to_face([ make_rect_xy(0,0,w,h) ], face_plane, th)

    elif aid == 2:  # DIAMOND (+): frame + horizontal + vertical bars
        a = max(0.0, inner_w); b = max(0.0, inner_h)
        built_area = rect_area - (inner_w*inner_h)                   # frame
        bars_area  = max(0.0, a*bt + b*bt - bt*bt)                   # two bars minus overlap
        built_area += bars_area
        cut_len_cm = outer_perim + inner_perim + 2*(2*(a+bt) + 2*(b+bt))
        preview += xform_to_face([
            make_rect_xy(0,0,w,h),
            make_rect_xy(0,0,inner_w,inner_h),
            make_rect_xy(0,0,a,bt),
            make_rect_xy(0,0,bt,b)
        ], face_plane, th)

    elif aid == 1:  # CROSS (X): frame + 2 diagonal bars
        a = max(0.0, min(inner_w, inner_h))
        diag = math.sqrt(2.0)*a
        built_area = rect_area - (inner_w*inner_h)
        bars_area  = max(0.0, 2.0*diag*bt - bt*bt)
        built_area += bars_area
        cut_len_cm = outer_perim + inner_perim + 2*(2*(diag+bt))
        r1 = make_rect_xy(0,0,diag,bt); r2 = make_rect_xy(0,0,diag,bt)
        r1.Transform(rg.Transform.Rotation(math.radians(45),  rg.Point3d(0,0,0)))
        r2.Transform(rg.Transform.Rotation(math.radians(-45), rg.Point3d(0,0,0)))
        preview += xform_to_face([
            make_rect_xy(0,0,w,h),
            make_rect_xy(0,0,inner_w,inner_h),
            r1, r2
        ], face_plane, th)

    elif aid == 3:  # QUARTER-RING: frame + annulus quarter at corner
        built_area = rect_area - (inner_w*inner_h)
        a = min(inner_w, inner_h)
        if a > 0:
            R = a/2.0
            rt = clamp(rt, 0.0, R-0.01)
            r_in = R - rt
            ring_area = 0.25 * math.pi * (R*R - r_in*r_in)
            ring_cut  = (math.pi/2.0)*(R + r_in) + 2.0*rt
            built_area += ring_area
        cut_len_cm = outer_perim + inner_perim + ring_cut
        # preview: outer + inner + ring edges
        sx = -1 if (cid in (0,3)) else +1
        sy = -1 if (cid in (0,1)) else +1
        cx = sx*(inner_w/2.0); cy = sy*(inner_h/2.0)
        crvs = [ make_rect_xy(0,0,w,h), make_rect_xy(0,0,inner_w,inner_h) ]
        if a > 0 and rt > 0:
            arc_outer = rg.Arc(rg.Circle(rg.Point3d(cx,cy,0), R), math.pi/2.0).ToNurbsCurve()
            arc_inner = rg.Arc(rg.Circle(rg.Point3d(cx,cy,0), R-rt), math.pi/2.0).ToNurbsCurve()
            p1 = rg.Point3d(cx+sx*R, cy, 0);     p2 = rg.Point3d(cx+sx*(R-rt), cy, 0)
            p3 = rg.Point3d(cx, cy+sy*R, 0);     p4 = rg.Point3d(cx, cy+sy*(R-rt), 0)
            rad1 = rg.Line(p1,p2).ToNurbsCurve(); rad2 = rg.Line(p3,p4).ToNurbsCurve()
            crvs += [arc_outer, arc_inner, rad1, rad2]
        preview += xform_to_face(crvs, face_plane, th)

    else:
        # Fallback → Solid
        built_area = rect_area
        cut_len_cm = outer_perim
        preview += xform_to_face([ make_rect_xy(0,0,w,h) ], face_plane, th)

    # ---------- metrics ----------
    panel_area_m2 = built_area / 10000.0     # cm² → m²
    cut_length_m  = cut_len_cm / 100.0       # cm  → m
    void_ratio    = max(0.0, min(1.0, 1.0 - (built_area / rect_area)))

    is_valid = True
    if inner_w <= 0 or inner_h <= 0:                             is_valid = False
    if aid in (1,2) and bt <= 0:                                 is_valid = False
    if aid == 3 and (rt <= 0 or rt >= min(inner_w,inner_h)/2.0): is_valid = False

    signature_raw = "{}|{}|{}|{}|{}|{}|{}|{}".format(
        aid, rr(w,1), rr(h,1), rr(ft,1), rr(bt,1), rr(rt,1), cid, rr(th,1)
    )
else:
    # invalid inputs → keep defaults (zeros) and empty preview/signature
    pass

# ---------- pack JSON & set outputs ----------
data = {
    "is_valid": bool(is_valid),
    "panel_area": float(rr(panel_area_m2, 4)),
    "cut_length": float(rr(cut_length_m, 4)),
    "void_ratio": float(rr(void_ratio, 4)),
    "fold_count": 0,
    "signature_raw": signature_raw
}
metrics_json = json.dumps(data)
preview_crv  = preview
# ---------- end python_3_script_3 ----------

panel = Panel(python_3_script_2.tile_ctx_json)

# ----
# Grouping panels
# Area with side length
# Perimeter
facade_panels = Curve(python_3_script_3.preview_crv)
explode = Explode(Curve=facade_panels, Recursive=True)  # -> Segments, Vertices
join_curves = JoinCurves(Curves=explode.Segments, Preserve=False)  # -> flatten(Curves)
dimensions = Dimensions(Surface=join_curves)  # -> UDimension, VDimension
area = Area(Geometry=facade_panels)  # -> Area, Centroid
areapanels = Data(area.Area)
u_dim = Data(dimensions.UDimension)
v_dim = Data(dimensions.VDimension)
expression = Expression(x=v_dim, y=u_dim, Expression="(x+y)*2")
expression_2 = Expression(x=areapanels, y=v_dim, z=u_dim, Expression="x+(y+z)")
panelperimetersides = Data(expression)
panelareasides = Data(expression_2)

# ----
# CNC program ≈ 60–120; small mold/jig ≈ 150–300; complex mold ≈ 300–450
number_slider_4 = Slider(60, range=60..450)

# ----
# Notes
# Budget >> 40–70 (precast/GRC) Mid >> 70–110 (aluminum/steel)>> High >> 110–180 (terracotta, premium finishes)
number_slider_5 = Slider(40, range=35..180)

# ----
# Stricter QC / more unique panels → higher waste
number_slider_6 = Slider(1.08, range=1.03..1.15)

# ----
# Laser steel/alum ≈ 1–3; waterjet stone ≈ 2–6
number_slider_7 = Slider(1, range=0.8..6)

# ----
# Smaller K = more reuse, cheaper production
number_slider_8 = Slider(3, range=3..12)

# ----
# Panel size in cm
number_slider_9 = Slider(500, range=0..1000)
rectangle = Rectangle(Plane=PlaneXY(0, 0, 0), XSize=number_slider_9, YSize=Slider(300, range=0..1000), Radius=0)  # -> Rectangle, Length

options = Options(
    Rotations=Slider(4, range=0..360),
    Wiggle=Slider(0, range=0..5.01),
    PlacementType=Slider(0, range=0..2),
    Spacing=Slider(0, range=0..100),
    Seed=Slider(30, range=0..100),
    SimplifyTolerance=Slider(1, range=0.01..10),
    Mutation=Slider(10, range=1..100),
    Population=Slider(10000, range=1..100000),
    Time=Slider(0, range=0..120),
    SheetFont="MecSoft_Font-1 -10")

# ----
# NESTING
python_3_script_4 = Python3Script(preview_crv=python_3_script_3.preview_crv, signature_raw=python_3_script_3.signature_raw)  # -> out, proto_crv, proto_label, proto_count, tile_to_proto, expanded_idx; inputs preview_crv: list, signature_raw: list
# ---------- python_3_script_4: Python ----------
import Rhino.Geometry as rg
import System
import scriptcontext as sc
from collections import OrderedDict

# --- helpers ---
def as_list(x):
    if x is None: return []
    if isinstance(x, (list, tuple)): return list(x)
    return [x]

def coerce_curve(obj):
    """Accept Curve/PolylineCurve/Guid; return an rg.Curve or None."""
    if isinstance(obj, rg.Curve):
        return obj.DuplicateCurve()
    # Polyline to curve
    if isinstance(obj, rg.Polyline):
        return obj.ToNurbsCurve()
    # Guid from Rhino doc
    if isinstance(obj, System.Guid):
        rh = sc.doc.Objects.Find(obj)
        if rh: 
            geo = rh.Geometry
            if isinstance(geo, rg.Curve): 
                return geo.DuplicateCurve()
    return None

def clean_curve(c):
    if c is None: return None
    c = c.DuplicateCurve()
    # planarize if needed
    if not c.IsPlanar():
        ok, pl = c.TryGetPlane(1e-6)
        if ok:
            c = rg.Curve.ProjectToPlane(c, pl)
    # close & simplify
    try: c.MakeClosed(1e-6)
    except: pass
    c = c.Simplify(rg.CurveSimplifyOptions.All, 1e-3, 1e-3) or c
    return c

# --- read inputs robustly ---
curves = [coerce_curve(x) for x in as_list(preview_crv)]
sigs   = [str(s) for s in as_list(signature_raw)]

n = min(len(curves), len(sigs))
curves = curves[:n]
sigs   = sigs[:n]

# --- group by signature ---
groups = OrderedDict()         # sig -> {"idx":int, "curves":[curve,...]}
tile_to_proto = []

for i in range(n):
    sig = sigs[i]
    if sig not in groups:
        groups[sig] = {"idx": len(groups), "curves": []}
    groups[sig]["curves"].append(curves[i])
    tile_to_proto.append(groups[sig]["idx"])

# --- representative curve per proto (first usable), counts, labels ---
proto_label, proto_crv, proto_count = [], [], []
expanded_idx = []   # order for expanded quantities (one per part)

for sig, g in groups.items():
    rep = None
    for c in g["curves"]:
        rep = clean_curve(c)
        if rep: break
    if rep is None:
        # fallback tiny circle to keep index alignment
        rep = rg.Circle(rg.Point3d(0,0,0), 0.001).ToNurbsCurve()
    proto_label.append(sig)
    proto_crv.append(rep)
    cnt = len(g["curves"])
    proto_count.append(cnt)
    # if you need an expanded order (one entry per part)
    expanded_idx.extend([g["idx"]]*cnt)
# ---------- end python_3_script_4 ----------
geometry = Geometry(Outlines=python_3_script_4.proto_crv, Simplify=Toggle(True), Hull=Toggle(False), Copies=python_3_script_4.proto_count)  # -> Geometry, Borders
sheets = Sheets(Polylines=rectangle.Rectangle, Gap=0.1)  # -> Sheets, Polylines
opennest2 = OpenNest2(Sheets=sheets.Sheets, Geometry=geometry.Geometry, Options=options, Iterations=1, Run=Toggle(True))  # -> Sheets, flatten(Borders), AllGeo, Transforms, SheetId, SheetTxt, Attributes

python_3_script_5 = Python3Script(
    metrics_json_list=python_3_script_3.metrics_json,
    material_per_m2=number_slider_5,
    cut_per_m=number_slider_7,
    waste_factor=number_slider_6,
    setup_cost=number_slider_4,
    K=number_slider_8)  # -> out, is_valid, area, cut_len, void_ratio, signature, panel_cost, proto_status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; disabled
# ---------- python_3_script_5: Python ----------
import json

# ------- helpers -------
def flatten(xs):
    if xs is None:
        return []
    # strings are iterable; treat as leaf
    if isinstance(xs, (str, bytes, dict)):
        return [xs]
    try:
        it = iter(xs)
    except TypeError:
        return [xs]
    out = []
    for x in it:
        out.extend(flatten(x))
    return out

def parse_metric(x):
    # accept dict or JSON string; return dict or None
    if x is None:
        return None
    if isinstance(x, dict):
        return x
    if isinstance(x, (str, bytes)):
        s = x.strip()
        if not s:
            return None
        try:
            d = json.loads(s)
            return d if isinstance(d, dict) else None
        except:
            return None
    return None

# ------- read & sanitize -------
raw = flatten(metrics_json_list)
ms = []
for x in raw:
    d = parse_metric(x)
    if d and "is_valid" in d:
        ms.append(d)
    # silently skip empties/invalid parses

# if nothing parsed, return safe empties
if not ms:
    is_valid, area, cut_len, void_ratio, signature = [], [], [], [], []
    panel_cost, proto_status = [], []
    total_cost, unique_protos, proto_labels = 0.0, 0, []
else:
    # expose raw metrics
    is_valid   = [bool(m.get("is_valid", False)) for m in ms]
    area       = [float(m.get("panel_area", 0.0)) for m in ms]
    cut_len    = [float(m.get("cut_length", 0.0)) for m in ms]
    void_ratio = [float(m.get("void_ratio", 0.0)) for m in ms]
    signature  = [str(m.get("signature_raw","")) for m in ms]

    # ---- prototype clustering with cap K ----
    K = max(1, int(K))
    proto_order = []      # first-use order
    proto_map   = {}      # signature -> canonical label
    proto_status = []

    for sig in signature:
        if sig in proto_map:
            proto_status.append("reuse")
            continue
        if sig and len(proto_order) < K:
            proto_order.append(sig)
            proto_map[sig] = sig
            proto_status.append("new")
        else:
            # bank full or empty signature -> force to first if available
            if proto_order:
                proto_map[sig] = proto_order[0]
            proto_status.append("forced")

    # counts per canonical prototype
    counts = {}
    for sig in signature:
        canon = proto_map.get(sig, sig)
        counts[canon] = counts.get(canon, 0) + 1

    # ---- cost model ----
    mp2  = float(material_per_m2)
    cpm  = float(cut_per_m)
    wf   = float(waste_factor)
    sc   = float(setup_cost)

    panel_cost = []
    for ok, a, L, sig in zip(is_valid, area, cut_len, signature):
        if not ok:
            panel_cost.append(1e9)
            continue
        base  = a * mp2 * wf + L * cpm
        canon = proto_map.get(sig, sig)
        share = sc / max(1, counts.get(canon, 1)) if canon else 0.0
        panel_cost.append(base + share)

    total_cost    = sum(panel_cost)
    unique_protos = len(proto_order)
    proto_labels  = list(proto_order)
# ---------- end python_3_script_5 ----------

is_valid = Panel(python_3_script_5.is_valid)  # disabled
area_2 = Panel(python_3_script_5.area)  # disabled
cut_len = Panel(python_3_script_5.cut_len)  # disabled
void_ratio = Panel(python_3_script_5.void_ratio)  # disabled
signature = Panel(python_3_script_5.signature)  # disabled
panel_cost = Panel(python_3_script_5.panel_cost)  # disabled
proto_status = Panel(python_3_script_5.proto_status)  # disabled
total_cost = Panel(python_3_script_5.total_cost)  # disabled
unique_protos = Panel(python_3_script_5.unique_protos)  # disabled
proto_labels = Panel(python_3_script_5.proto_labels)  # disabled

# ----
# Group panels based on dimentions
create_set = CreateSet(List=panelareasides)  # -> Set, Map
area_with_length_of_groups = Panel(create_set.Map)
member_index = MemberIndex(Set=panelareasides, Member=create_set.Set)  # -> Index, Count
mappanelgroups = Data(create_set.Map)
nr_of_panels_per_group = Panel(member_index.Count)
indexpanelgroups = Data(member_index.Index)
countpanelgroups = Data(member_index.Count)

# ----
# Visualise
mappanelgroups_2 = Data(mappanelgroups)
bounds = Bounds(Numbers=mappanelgroups_2)
deconstruct_domain = DeconstructDomain(Domain=bounds)  # -> Start, End
gradient = Gradient(
    LowerLimit=deconstruct_domain.Start,
    UpperLimit=deconstruct_domain.End,
    Parameter=mappanelgroups_2,
    stops=[0: RGB(243, 57, 0), 0: RGB(236, 27, 60), 0.111: RGB(210, 0, 118), 0.223: RGB(103, 0, 120), 0.36: RGB(39, 72, 161), 0.484: RGB(1, 192, 229), 0.618: RGB(18, 178, 90), 0.729: RGB(79, 186, 8), 0.842: RGB(220, 237, 32), 1: RGB(243, 57, 0), 1: RGB(247, 159, 20)])
panels = Surface(facade_panels)
custom_preview = CustomPreview(Geometry=panels, Material=gradient)

# ----
# COST CALCULATOR
length = Length(Curve=opennest2.Borders)
sheet = Curve(opennest2.Sheets)
area_3 = Area(Geometry=sheet)  # -> Area, Centroid
division = Division(A=area_3.Area, B="10000")
division_2 = Division(A=length, B="10000")
fabrication_cost_per_m = Panel("30")
cost_per_m2 = Panel("30")
integer = Integer(division)
multiplication = Multiplication(A=integer, B=cost_per_m2)
multiplication_2 = Multiplication(A=division_2, B=fabrication_cost_per_m)  # -> flatten(Result)
mass_addition = MassAddition(Input=multiplication)  # -> Result, PartialResults
mass_addition_2 = MassAddition(Input=multiplication_2)  # -> Result, PartialResults
addition = Addition(A=mass_addition.Result, B=mass_addition_2.Result)
total_cost_2 = Panel(addition)
