# Grasshopper definition FacadeAuthoring.gh (Grasshopper 1.0.8)
# plug-ins: Hops

# ----
# layout generator
number_slider = Slider(0.3, range=0..1)
xy_plane = XYPlane(Origin=Point(0, 0, 0))
python_3_script = Python3Script(
    face_plane=xy_plane,
    facade_w=Slider(600, range=0..1000),
    facade_h=Slider(420, range=0..1000),
    baseSize=Slider(30, range=0..100),
    sizes_text="1,2,3,5,8",
    seed=Slider(1, range=0..1),
    small_bias=number_slider)  # -> out, tile_planes, tile_w, tile_h, span, i_idx, j_idx, corner_id_suggest, rect_preview
# ---------- python_3_script: Python ----------
import random
from math import floor
import Rhino.Geometry as rg

# inputs:
# face_plane: rg.Plane
# facade_w, facade_h, baseSize: float (cm)
# sizes_text: str like "1,2,3,5,8"
# seed: int
# small_bias: 0..1

# outputs to define:
tile_planes, tile_w, tile_h, span, i_idx, j_idx = [], [], [], [], [], []
corner_id_suggest, rect_preview = [], []

# grid in base cells
nx = int(floor(facade_w / baseSize))
ny = int(floor(facade_h / baseSize))
if nx <= 0 or ny <= 0: 
    raise ValueError("facade size too small for baseSize")

# parse sizes, largest first
S = [int(s.strip()) for s in sizes_text.split(",") if s.strip().isdigit()]
S = sorted(set(S), reverse=True)
if not S: S = [1,2,3,5,8]
random.seed(int(seed))

used = [[False]*nx for _ in range(ny)]

def fits(i, j, s):
    if i + s > nx or j + s > ny: return False
    for jj in range(j, j+s):
        for ii in range(i, i+s):
            if used[jj][ii]: return False
    return True

def mark(i, j, s):
    for jj in range(j, j+s):
        for ii in range(i, i+s):
            used[jj][ii] = True

# scan top->bottom, left->right (Y first so visuals feel natural)
for j in range(ny):
    for i in range(nx):
        if used[j][i]: 
            continue
        chosen = None
        # choose largest that fits
        for s in S:
            if fits(i, j, s):
                chosen = s
                # smallness bias: sometimes step down to a smaller one that also fits
                idx = S.index(s)
                while random.random() < max(0.0, min(1.0, small_bias)) and idx < len(S)-1:
                    s2 = S[idx+1]
                    if fits(i, j, s2):
                        chosen = s2
                        idx += 1
                    else:
                        break
                break
        if chosen is None:
            # fallback: fill with 1 if possible
            if fits(i, j, 1): 
                chosen = 1
            else:
                continue

        mark(i, j, chosen)

        w = chosen * baseSize
        h = w
        # local center of this tile relative to face_plane origin (facade center)
        cx = -facade_w/2.0 + (i + chosen/2.0) * baseSize
        cy = -facade_h/2.0 + (j + chosen/2.0) * baseSize

        # plane at tile center, same axes as facade plane
        origin = face_plane.PointAt(cx, cy)
        tp = rg.Plane(origin, face_plane.XAxis, face_plane.YAxis)

        tile_planes.append(tp)
        tile_w.append(w); tile_h.append(h)
        span.append(chosen)
        i_idx.append(i); j_idx.append(j)

        # corner id suggestion for quarter‑rings so 2x2 blocks assemble circles
        # pattern by cell parity (works even when spans mix):
        # (even,even)->0, (odd,even)->1, (odd,odd)->2, (even,odd)->3
        cid = (i % 2) + 2 * (j % 2)
        corner_id_suggest.append(cid)

        # rectangle preview (in face_plane space)
        rx = rg.Interval(cx - w/2.0, cx + w/2.0)
        ry = rg.Interval(cy - h/2.0, cy + h/2.0)
        rect = rg.Rectangle3d(face_plane, rx, ry)
        rect_preview.append(rect.ToNurbsCurve())
# ---------- end python_3_script ----------

# ----
# layout generator
number_slider_2 = Slider(0.3, range=0..1)
xy_plane_2 = XYPlane(Origin=Point(0, 0, 0))
python_3_script_2 = Python3Script(
    face_plane=xy_plane_2,
    facade_w=Slider(600, range=0..1000),
    facade_h=Slider(420, range=0..1000),
    baseSize=Slider(30, range=0..100),
    sizes_text="1,2,3,5,8",
    seed=Slider(1, range=0..1),
    small_bias=number_slider_2)  # -> out, tile_planes, tile_w, tile_h, span, i_idx, j_idx, corner_id_suggest, rect_preview; same code as python_3_script

# ----
# archetype + metrics
number_slider_3 = Slider(1, range=0..3)
python_3_script_3 = Python3Script(
    face_plane=python_3_script_2.tile_planes,
    tile_w=python_3_script_2.tile_w,
    tile_h=python_3_script_2.tile_h,
    archetype_id=number_slider_3,
    frame_t=Slider(4, range=0..10),
    bar_t=Slider(3, range=0..10),
    ring_t=Slider(3, range=0..10),
    corner_id=python_3_script_2.corner_id_suggest,
    theta_deg=Slider(0, range=0..90))  # -> metrics_json, signature_raw, preview_crv
# ---------- python_3_script_3: Python ----------
import math, json
import Rhino.Geometry as rg

# ---------- helpers ----------
def clamp(x, lo, hi): return max(lo, min(hi, x))
def rr(x, n): return round(float(x), n)

def valid_inputs(w,h,ft,bt,rt):
    if w is None or h is None:                return False, "missing size"
    if w <= 0 or h <= 0:                      return False, "non-positive size"
    if ft is None or bt is None or rt is None:return False, "missing thickness"
    if ft < 0 or bt < 0 or rt < 0:            return False, "negative thickness"
    if 2*ft >= min(w,h):                      return False, "frame too thick"
    return True, ""

def make_rect_xy(cx, cy, ww, hh):
    rx = rg.Interval(cx-ww/2.0, cx+ww/2.0)
    ry = rg.Interval(cy-hh/2.0, cy+hh/2.0)
    return rg.Rectangle3d(rg.Plane.WorldXY, rx, ry).ToNurbsCurve()

def xform_to_face(curves, face_plane, theta_deg):
    # rotate in local XY by theta, then orient XY->face_plane
    rot = rg.Transform.Rotation(math.radians(float(theta_deg)), rg.Point3d(0,0,0))
    xform = rg.Transform.PlaneToPlane(rg.Plane.WorldXY, face_plane)
    out=[]
    for c in curves:
        cc = c.DuplicateCurve()
        cc.Transform(rot); cc.Transform(xform)
        out.append(cc)
    return out

# ---------- read / sanitize inputs ----------
w   = float(tile_w)
h   = float(tile_h)
ft  = float(frame_t)
bt  = float(bar_t)
rt  = float(ring_t)
aid = int(archetype_id)
cid = int(corner_id) % 4
th  = float(theta_deg)

# defaults so outputs are always defined
preview = []
panel_area_m2 = 0.0
cut_length_m  = 0.0
void_ratio    = 1.0
is_valid      = False
signature_raw = ""

ok, msg = valid_inputs(w,h,ft,bt,rt)

if ok:
    # ---------- base numbers (cm) ----------
    outer_perim = 2.0*(w+h)
    inner_w = w - 2.0*ft
    inner_h = h - 2.0*ft
    inner_perim = 2.0*(inner_w + inner_h)
    rect_area = w*h
    built_area = 0.0
    ring_cut = 0.0

    # ---------- archetypes ----------
    if aid == 0:  # SOLID
        built_area = rect_area
        cut_len_cm = outer_perim
        preview += xform_to_face([ make_rect_xy(0,0,w,h) ], face_plane, th)

    elif aid == 2:  # DIAMOND (+): frame + horizontal + vertical bars
        a = max(0.0, inner_w); b = max(0.0, inner_h)
        built_area = rect_area - (inner_w*inner_h)                   # frame
        bars_area  = max(0.0, a*bt + b*bt - bt*bt)                   # two bars minus overlap
        built_area += bars_area
        cut_len_cm = outer_perim + inner_perim + 2*(2*(a+bt) + 2*(b+bt))
        preview += xform_to_face([
            make_rect_xy(0,0,w,h),
            make_rect_xy(0,0,inner_w,inner_h),
            make_rect_xy(0,0,a,bt),
            make_rect_xy(0,0,bt,b)
        ], face_plane, th)

    elif aid == 1:  # CROSS (X): frame + 2 diagonal bars
        a = max(0.0, min(inner_w, inner_h))
        diag = math.sqrt(2.0)*a
        built_area = rect_area - (inner_w*inner_h)
        bars_area  = max(0.0, 2.0*diag*bt - bt*bt)
        built_area += bars_area
        cut_len_cm = outer_perim + inner_perim + 2*(2*(diag+bt))
        r1 = make_rect_xy(0,0,diag,bt); r2 = make_rect_xy(0,0,diag,bt)
        r1.Transform(rg.Transform.Rotation(math.radians(45),  rg.Point3d(0,0,0)))
        r2.Transform(rg.Transform.Rotation(math.radians(-45), rg.Point3d(0,0,0)))
        preview += xform_to_face([
            make_rect_xy(0,0,w,h),
            make_rect_xy(0,0,inner_w,inner_h),
            r1, r2
        ], face_plane, th)

    elif aid == 3:  # QUARTER-RING: frame + annulus quarter at corner
        built_area = rect_area - (inner_w*inner_h)
        a = min(inner_w, inner_h)
        if a > 0:
            R = a/2.0
            rt = clamp(rt, 0.0, R-0.01)
            r_in = R - rt
            ring_area = 0.25 * math.pi * (R*R - r_in*r_in)
            ring_cut  = (math.pi/2.0)*(R + r_in) + 2.0*rt
            built_area += ring_area
        cut_len_cm = outer_perim + inner_perim + ring_cut
        # preview: outer + inner + ring edges
        sx = -1 if (cid in (0,3)) else +1
        sy = -1 if (cid in (0,1)) else +1
        cx = sx*(inner_w/2.0); cy = sy*(inner_h/2.0)
        crvs = [ make_rect_xy(0,0,w,h), make_rect_xy(0,0,inner_w,inner_h) ]
        if a > 0 and rt > 0:
            arc_outer = rg.Arc(rg.Circle(rg.Point3d(cx,cy,0), R), math.pi/2.0).ToNurbsCurve()
            arc_inner = rg.Arc(rg.Circle(rg.Point3d(cx,cy,0), R-rt), math.pi/2.0).ToNurbsCurve()
            p1 = rg.Point3d(cx+sx*R, cy, 0);     p2 = rg.Point3d(cx+sx*(R-rt), cy, 0)
            p3 = rg.Point3d(cx, cy+sy*R, 0);     p4 = rg.Point3d(cx, cy+sy*(R-rt), 0)
            rad1 = rg.Line(p1,p2).ToNurbsCurve(); rad2 = rg.Line(p3,p4).ToNurbsCurve()
            crvs += [arc_outer, arc_inner, rad1, rad2]
        preview += xform_to_face(crvs, face_plane, th)

    else:
        # Fallback → Solid
        built_area = rect_area
        cut_len_cm = outer_perim
        preview += xform_to_face([ make_rect_xy(0,0,w,h) ], face_plane, th)

    # ---------- metrics ----------
    panel_area_m2 = built_area / 10000.0     # cm² → m²
    cut_length_m  = cut_len_cm / 100.0       # cm  → m
    void_ratio    = max(0.0, min(1.0, 1.0 - (built_area / rect_area)))

    is_valid = True
    if inner_w <= 0 or inner_h <= 0:                             is_valid = False
    if aid in (1,2) and bt <= 0:                                 is_valid = False
    if aid == 3 and (rt <= 0 or rt >= min(inner_w,inner_h)/2.0): is_valid = False

    signature_raw = "{}|{}|{}|{}|{}|{}|{}|{}".format(
        aid, rr(w,1), rr(h,1), rr(ft,1), rr(bt,1), rr(rt,1), cid, rr(th,1)
    )
else:
    # invalid inputs → keep defaults (zeros) and empty preview/signature
    pass

# ---------- pack JSON & set outputs ----------
data = {
    "is_valid": bool(is_valid),
    "panel_area": float(rr(panel_area_m2, 4)),
    "cut_length": float(rr(cut_length_m, 4)),
    "void_ratio": float(rr(void_ratio, 4)),
    "fold_count": 0,
    "signature_raw": signature_raw
}
metrics_json = json.dumps(data)
preview_crv  = preview
# ---------- end python_3_script_3 ----------

hops = Hops(
    CacheResultsInMemory=True,
    CacheSolveResults=True,
    RemoteDefinitionLocation="C:\Users\user\Desktop\VS\RL_Voxel-Agent_PPO_V1\TileEvaluator.gh",
    RemoteSolveVersion=(0, 1, 0),
    ShowInput_Enabled=False,
    ShowInput_Path=False,
    SynchronousSolve=True)
