# Grasshopper definition RL_Voxel_V1.gh (Grasshopper 1.0.8)
# plug-ins: MeshEdit Components, Cyclops

# ----
# must be on
# reads voxels, makes boxes
trigger = Trigger(Interval=100, TimerInterval=100, Target=py3)  # disabled
py3 = Python3Script()  # -> out, a
# ---------- py3: Python ----------
import json
import os
import Rhino.Geometry as rg

path = r"D:\Users\angel\OneDrive\Desktop\IAAC\THESIS\voxelagent1\RL_Voxel-Agent_PPO_V1\temp_voxel_input.json"
boxes = []

if os.path.exists(path):
    with open(path, 'r') as f:
        voxels = json.load(f)["voxels"]

    size = len(voxels)
    for x in range(size):
        for y in range(size):
            for z in range(size):
                if voxels[x][y][z] == 1:
                    pt1 = rg.Point3d(x, y, z)
                    pt2 = rg.Point3d(x + 1, y + 1, z + 1)
                    bbox = rg.BoundingBox(pt1, pt2)
                    boxes.append(rg.Box(bbox))

# Output: list of voxel Boxes
a = boxes
# ---------- end py3 ----------
geo = Geometry(graft(py3.a))
debrep = DeconstructBrep(Brep=geo)  # -> simplify(Faces), Edges, Vertices
mesh_uv = MeshSurface(Surface=debrep.Faces, UCount="2", VCount="2", Overhang=True, Equalize=False)

# ----
# output_steps folder path
panel = Panel("D:\Users\angel\OneDrive\Desktop\IAAC\THESIS\voxelagent1\RL_Voxel-Agent_PPO_V1\output_steps")  # disabled

number_slider = Slider(19, range=0..19)  # disabled
path = FilePath(panel)  # disabled
py3_2 = Python3Script(path=path, frame=number_slider)  # -> out, a; disabled
# ---------- py3_2: Python ----------
import Rhino.Geometry as rg
import json
import os

json_file = os.path.join(path, f"step_{int(frame):03}.json")

with open(json_file, 'r') as f:
    data = json.load(f)

voxels = data["voxels"]

boxes = []

grid_size = len(voxels)

for x in range(grid_size):
    for y in range(grid_size):
        for z in range(grid_size):
            if voxels[x][y][z] == 1:
                corner1 = rg.Point3d(x, y, z)
                corner2 = rg.Point3d(x + 1, y + 1, z + 1)
                bbox = rg.BoundingBox(corner1, corner2)
                box = rg.Box(bbox)
                boxes.append(box)

a = boxes
# ---------- end py3_2 ----------

# ----
# epw
panel_2 = Panel("https://energyplus-weather.s3.amazonaws.com/europe_wmo_region_6/ESP/ESP_Madrid.082210_IWEC/ESP_Madrid.082210_IWEC.zip")
downloadepw = LBDownloadWeather(weather_URL=panel_2)  # -> epw_file, stat_file, ddy_file; plug-in component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

# ---- group: Create panels
facade_panels = Mesh(mesh_uv)

# ---- group: Specify hemisphere subdivision
subdivision = Subdivision(CyclopsValueList="EqualAreaAspectSubdivision", version="1.0.0.0")
cell_count = Slider(512, range=0..1000)
hemisphere = Hemisphere(CellCount=cell_count, Subdivision=subdivision, method="Hemisphere", version="0.0.0.DevBuild")

# ----
panel_3 = Panel("""3
6
9
12""")
series = Series(Start=0, Step=1, Count="24")
tp = FromSchedule(Months=panel_3, Days="21", Hours=series, TimeStep=1, method="From Schedule", version="1.2.0.60000")

# ----
# reward weights
sunhours_weight = Slider(0.5, range=0.1..1)
system_radiation_weight = Slider(1, range=0.1..1)
radiation_weight = Slider(0.5, range=0.1..1)

# ----
# CUMULATIVE RADIATION
explode = MeshExplode(Mesh=mesh_uv, Interpolate=False)
trim = TrimTree(Tree=explode, Depth=1)
G = Geometry(Mesh=flatten(mesh_uv), MaterialName="Default Material", Parameter=0, method="Geometry", version="1.0.0.0")
face_normals = FaceNormals(Mesh=facade_panels)  # -> Centers, Normals
A = AnalysisPoint(Position=face_normals.Centers, Direction=face_normals.Normals, method="Analysis Point", version="1.0.0.0")
analysis_points = CyclopsObject(A, version="0.0.0.DevBuild")
trim_2 = TrimTree(Tree=analysis_points, Depth=1)
hemisphere_2 = Data(hemisphere)

# ---- group: Cyclops geometry
G_2 = GeometryGroup(
    Name="Default Geometry Group",
    Geometry=G,
    VisibilityMask="""{
  "Mask1": true,
  "Mask2": true,
  "Mask3": true,
  "Mask4": true,
  "Mask5": true,
  "Mask6": true,
  "Mask7": true,
  "Mask8": true,
  "BitMap": [
    true,
    true,
    true,
    true,
    true,
    true,
    true,
    true
  ]
}""",
    Transforms={TransformCount=1, Name="Generic", m00=1, m01=0, m02=0, m03=0, m10=0, m11=1, m12=0, m13=0, m20=0, m21=0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},
    IntersectionType="Target",
    method="Geometry Group",
    version="1.0.0.0")

# ---- group: Create sky instance from EPW file
W = Weather(Path=downloadepw.epw_file, NorthVector=Vector(0, 1, 0), LuminousEfficacyModel="MeasuredIlluminance", version="1.0.0.0")
fytp = FullYear(TimeStep=1, version="1.0.0.0")
ss = SkySeries(
    Weather=W,
    Hemisphere=hemisphere_2,
    TimePattern=fytp,
    LuminanceDistributionModel="CIEStandardSkyModel",
    version="1.0.0.0")

# ---- group: Create shading masks for each analysis point
scene_objects = CyclopsObject(G_2, version="0.0.0.DevBuild")
hemisphere_3 = Data(hemisphere)
analysis_points_2 = CyclopsObject(trim_2, version="0.0.0.DevBuild")
number_slider_2 = Slider(200, range=0..1000)

# ----
do = DirectOnly(Samples=number_slider_2, version="1.0.0.0")

# ---- group: Create shading masks for each analysis point (continued)
sma = ShadingMaskAnalysis(
    Run=Toggle(True),
    SceneObjects=scene_objects,
    AnalysisPoints=analysis_points_2,
    Hemisphere=hemisphere_3,
    SamplingSettings=do,
    VisibilityMask="""{
  "Mask1": true,
  "Mask2": true,
  "Mask3": true,
  "Mask4": true,
  "Mask5": true,
  "Mask6": true,
  "Mask7": true,
  "Mask8": true,
  "BitMap": [
    true,
    true,
    true,
    true,
    true,
    true,
    true,
    true
  ]
}""",
    version="1.0.0.0")  # -> Scene, ShadingMasks

# ---- group: Run cumulative solar radiation analysis
radiation_analysis = CumulativeRadiation(ShadingMasks=sma.ShadingMasks, SkySeries=ss, method="Cumulative Radiation", version="0.0.0.DevBuild")  # -> CumulativeRadiation, AverageIrradiance

# ---- group: Visualize analysis results on facade panels
analysis_results = Number(simplify(radiation_analysis.CumulativeRadiation))
facade_panels_2 = Geometry(trim)
gradient = Gradient(
    LowerLimit=0,
    UpperLimit=Slider(700, range=0..1000),
    Parameter=analysis_results,
    stops=[0: RGB(75, 107, 169), 0.25: RGB(173, 203, 249), 0.5: RGB(254, 244, 84), 0.75: RGB(234, 126, 0), 1: RGB(234, 38, 0)])
mesh_colours = MeshColours(Mesh=graft(facade_panels_2), Colours=graft(gradient))

# ----
# maximise sun hours
sr = SunRig(
    NorthVector=Vector(0, 1, 0),
    Location="""{
  "Latitude": 51.48,
  "Longitude": 0,
  "Timezone": 0,
  "Country": "United Kingdom",
  "AdminDistrict": "London",
  "AddressLine": "Greenwich"
}""",
    TimePattern=tp,
    CutOffElevation=0,
    method="Sun Rig",
    version="1.2.0.60000")
sha = SunlightHourAnalysis(
    Run=True,
    SceneObjects=scene_objects,
    SunRig=sr,
    AnalysisPoints=analysis_points_2,
    VisibilityMask="""{
  "Mask1": true,
  "Mask2": true,
  "Mask3": true,
  "Mask4": true,
  "Mask5": true,
  "Mask6": true,
  "Mask7": true,
  "Mask8": true,
  "BitMap": [
    true,
    true,
    true,
    true,
    true,
    true,
    true,
    true
  ]
}""",
    method="Sunlight Hour Analysis",
    version="1.2.0.60000")  # -> Scene, SunlightHours

# ----
# cumulative sun hours per voxel
ma = MassAddition(Input=sha.SunlightHours)  # -> Result, PartialResults
data = Data(simplify(ma.Result))

# ----
# cumulative radiation per voxel
ma_2 = MassAddition(Input=analysis_results)  # -> Result, PartialResults
data_2 = Data(simplify(ma_2.Result))

# ----
# overall radiation of the system
ma_3 = MassAddition(Input=flatten(data_2))  # -> Result, PartialResults

# ----
# calculate reward
merge = Merge(Data1=data_2, Data2=data)
py3_3 = Python3Script(metrics=merge, w_rad=radiation_weight, sys_rad=ma_3.Result, w_sys=system_radiation_weight, w_sun=sunhours_weight)  # -> out, a; inputs metrics: tree
# ---------- py3_3: Python ----------
import json
import os

output_file = r"D:\Users\angel\OneDrive\Desktop\IAAC\THESIS\voxelagent1\RL_Voxel-Agent_PPO_V1\temp_reward.json"

# ✅ Validate weight inputs
if w_rad is None or w_sun is None or w_sys is None:
    print("❌ Missing one or more weight inputs")
    exit()

# ✅ Validate system-level metric
if sys_rad is None:
    print("❌ Missing system radiation input")
    exit()

total_voxel_reward = 0.0
valid = True

try:
    for i in range(metrics.BranchCount):
        raw_entry = metrics.Branch(i)
        entry = list(raw_entry)

        if not isinstance(entry, list) or len(entry) < 2:
            print(f"❌ Invalid metric at index {i}: {entry}")
            valid = False
            break

        rad = float(entry[0])
        sun = float(entry[1])
        voxel_reward = (w_rad * rad) + (w_sun * sun)
        total_voxel_reward += voxel_reward

except Exception as e:
    print("❌ Error in parsing metrics:", e)
    valid = False

# ✅ Compute final reward with system-level term
if valid:
    final_reward = total_voxel_reward + (w_sys * sys_rad)

    try:
        with open(output_file, 'w') as f:
            json.dump({"reward": float(final_reward)}, f)
        print(f"✅ Reward written: {final_reward}")
    except Exception as e:
        print("❌ Failed to write reward file:", e)
else:
    print("❌ Reward not written due to error.")
# ---------- end py3_3 ----------
