# Grasshopper definition RL_Voxel_V2.gh (Grasshopper 1.0.8)
# plug-ins: MeshEdit Components, MetaHopper, Cyclops

# ----
# output_steps folder path
panel = Panel("output_steps_vec")
relpath = RelativePath(Path=panel)
panel_2 = Panel(relpath)

number_slider = Slider(72, range=0..72)
path = FilePath(panel_2)
py3 = Python3Script(path=path, frame=Slider(100, range=0..100))  # -> out, a
# ---------- py3: Python ----------
import Rhino.Geometry as rg
import json
import os

json_file = os.path.join(path, f"step_{int(frame):03}.json")

with open(json_file, 'r') as f:
    data = json.load(f)

voxels = data["voxels"]

boxes = []

grid_size = len(voxels)

for x in range(grid_size):
    for y in range(grid_size):
        for z in range(grid_size):
            if voxels[x][y][z] == 1:
                corner1 = rg.Point3d(x, y, z)
                corner2 = rg.Point3d(x + 1, y + 1, z + 1)
                bbox = rg.BoundingBox(corner1, corner2)
                box = rg.Box(bbox)
                boxes.append(box)

a = boxes
# ---------- end py3 ----------
scale = Scale(Geometry=py3.a, Center=Point(0, 0, 0), Factor=Slider(3, range=1.1..3))  # -> Geometry, Transform
toggle = BooleanToggle(False)
mesh = Mesh(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)
geo = Geometry([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])
pt = Point(Point(431.8451825, 329.1845195, 36.25916457))
voxelgetter = Python3Script(num_steps="12", run=toggle)  # -> out, a; inputs num_steps: Int32, run: Boolean
# ---------- voxelgetter: Python ----------
# venv: lichen
#r: aiohttp
import asyncio
import aiohttp
import json
import Rhino.Geometry as rg

async def poll_for_voxel(session):
    while True:
        async with session.get("http://localhost:5555/emit") as resp:
            emit = await resp.json()
            if emit.get("voxel"):
                async with session.get("http://localhost:5555/env/get_voxel") as voxel_resp:
                    if voxel_resp.ok:
                        voxel_data = (await voxel_resp.json()).get("voxel_data")
                        print(f"Received voxel data: {voxel_data}")
                        return voxel_data
            await asyncio.sleep(0.5)

async def send_reward(session, reward):
    await session.post("http://localhost:5555/env/send_reward", json={"reward": reward})

async def main():
    async with aiohttp.ClientSession() as session:
        i = 0

        while i < num_steps:
            voxel_data = await poll_for_voxel(session)
            boxes = []

            voxels = json.loads(voxel_data)

            size = len(voxels)
            for x in range(size):
                for y in range(size):
                    for z in range(size):
                        if voxels[x][y][z] == 1:
                            pt1 = rg.Point3d(x, y, z)
                            pt2 = rg.Point3d(x + 1, y + 1, z + 1)
                            bbox = rg.BoundingBox(pt1, pt2)
                            boxes.append(rg.Box(bbox))
            a = boxes
            i+=1

if __name__ == "__main__":
    if run:
        asyncio.run(main())
# ---------- end voxelgetter ----------

# ----
# reads voxels, makes boxes
panel_3 = Panel("temp_voxel_input.json")
relpath_2 = RelativePath(Path=panel_3)
trigger = Trigger(Interval=50, TimerInterval=50, Target=py3_2)  # disabled
py3_2 = Python3Script(path=relpath_2)  # -> out, a; inputs path: String
# ---------- py3_2: Python ----------
import json
import os
import Rhino.Geometry as rg

boxes = []

if os.path.exists(path):
    with open(path, 'r') as f:
        voxels = json.load(f)["voxels"]

    size = len(voxels)
    for x in range(size):
        for y in range(size):
            for z in range(size):
                if voxels[x][y][z] == 1:
                    pt1 = rg.Point3d(x, y, z)
                    pt2 = rg.Point3d(x + 1, y + 1, z + 1)
                    bbox = rg.BoundingBox(pt1, pt2)
                    boxes.append(rg.Box(bbox))

# Output: list of voxel Boxes
a = boxes
# ---------- end py3_2 ----------
geo_2 = Geometry(graft(voxelgetter.a))
debrep = DeconstructBrep(Brep=geo_2)  # -> simplify(Faces), Edges, Vertices
mesh_uv = MeshSurface(Surface=debrep.Faces, UCount="3", VCount="3", Overhang=True, Equalize=False)

vec2pt = Vector2Pt(PointA=pt, PointB="0,0,0", Unitize=False)  # -> Vector, Length
panel_4 = Panel(voxelgetter.a)
move = Move(Geometry=mesh, Motion=vec2pt.Vector)  # -> Geometry, Transform
move_2 = Move(Geometry=geo, Motion=vec2pt.Vector)  # -> Geometry, Transform
preview = CustomPreview(Geometry=move_2.Geometry, Material=ColourSwatch(SwatchColor=RGB(255, 255, 255)))
preview_2 = CustomPreview(Geometry=move.Geometry, Material=ColourSwatch(SwatchColor=RGB(69, 69, 69)))
scale_2 = Scale(Geometry=mesh_uv, Center=Point(0, 0, 0), Factor=Slider(3, range=0..10))  # -> Geometry, Transform
mesh_2 = Mesh(scale_2.Geometry)

# ----
# epw
panel_5 = Panel("https://energyplus-weather.s3.amazonaws.com/europe_wmo_region_6/ESP/ESP_Barcelona.081810_SWEC/ESP_Barcelona.081810_SWEC.zip")
downloadepw = LBDownloadWeather(weather_URL=panel_5)  # -> epw_file, stat_file, ddy_file; plug-in component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

# ---- group: Create panels
facade_panels = Mesh(mesh_2)

# ---- group: Specify hemisphere subdivision
subdivision = Subdivision(CyclopsValueList="EqualAreaAspectSubdivision", version="1.0.0.0")
cell_count = Slider(512, range=0..1000)
hemisphere = Hemisphere(CellCount=cell_count, Subdivision=subdivision, method="Hemisphere", version="0.0.0.DevBuild")

# ---- group: SITGES CATALONIA
L = LocationFromCoordinates(Latitude="41.24384838117473", Longitude="1.8195874104506968", method="Location From Coordinates", version="1.2.0.60000")

# ----
# reward weights
sunhours_weight = Slider(1, range=0.1..1)
radiation_weight = Slider(0.8, range=0.1..1)

relpath_3 = RelativePath(Path="temp_reward.json")
panel_6 = Panel(relpath_3)

# ----
# CUMULATIVE RADIATION
explode = MeshExplode(Mesh=mesh_2, Interpolate=False)
G = Geometry(Mesh=flatten(mesh_2), MaterialName="facade", Parameter=0, method="Geometry", version="1.0.0.0")
face_normals = FaceNormals(Mesh=facade_panels)  # -> Centers, Normals
trim = TrimTree(Tree=explode, Depth=1)
A = AnalysisPoint(Position=face_normals.Centers, Direction=face_normals.Normals, method="Analysis Point", version="1.0.0.0")
analysis_points = CyclopsObject(A, version="0.0.0.DevBuild")
trim_2 = TrimTree(Tree=analysis_points, Depth=1)
hemisphere_2 = Data(hemisphere)

# ---- group: Cyclops geometry
G_2 = GeometryGroup(
    Name="Default Geometry Group",
    Geometry=G,
    VisibilityMask="""{
  "Mask1": true,
  "Mask2": true,
  "Mask3": true,
  "Mask4": true,
  "Mask5": true,
  "Mask6": true,
  "Mask7": true,
  "Mask8": true,
  "BitMap": [
    true,
    true,
    true,
    true,
    true,
    true,
    true,
    true
  ]
}""",
    Transforms={TransformCount=1, Name="Generic", m00=1, m01=0, m02=0, m03=0, m10=0, m11=1, m12=0, m13=0, m20=0, m21=0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},
    IntersectionType="Target",
    method="Geometry Group",
    version="1.0.0.0")

# ---- group: Create sky instance from EPW file
W = Weather(Path=downloadepw.epw_file, NorthVector=Vector(0, 1, 0), LuminousEfficacyModel="MeasuredIlluminance", version="1.0.0.0")
fytp = FullYear(TimeStep=1, version="1.0.0.0")
ss = SkySeries(
    Weather=W,
    Hemisphere=hemisphere_2,
    TimePattern=fytp,
    LuminanceDistributionModel="CIEStandardSkyModel",
    version="1.0.0.0")

# ---- group: Create shading masks for each analysis point
scene_objects = CyclopsObject(G_2, version="0.0.0.DevBuild")
analysis_points_2 = CyclopsObject(trim_2, version="0.0.0.DevBuild")
hemisphere_3 = Data(hemisphere_2)
number_slider_2 = Slider(50, range=0..1000)

# ----
do = DirectOnly(Samples=number_slider_2, version="1.0.0.0")

# ---- group: Create shading masks for each analysis point (continued)
sma = ShadingMaskAnalysis(
    Run=Toggle(True),
    SceneObjects=scene_objects,
    AnalysisPoints=analysis_points_2,
    Hemisphere=hemisphere_3,
    SamplingSettings=do,
    VisibilityMask="""{
  "Mask1": true,
  "Mask2": true,
  "Mask3": true,
  "Mask4": true,
  "Mask5": true,
  "Mask6": true,
  "Mask7": true,
  "Mask8": true,
  "BitMap": [
    true,
    true,
    true,
    true,
    true,
    true,
    true,
    true
  ]
}""",
    version="1.0.0.0")  # -> Scene, ShadingMasks

# ---- group: Run cumulative solar radiation analysis
radiation_analysis = CumulativeRadiation(ShadingMasks=sma.ShadingMasks, SkySeries=ss, method="Cumulative Radiation", version="0.0.0.DevBuild")  # -> CumulativeRadiation, AverageIrradiance

# ---- group: Visualize analysis results on facade panels
analysis_results = Number(simplify(radiation_analysis.CumulativeRadiation))
facade_panels_2 = Geometry(trim)
gradient = Gradient(
    LowerLimit=0,
    UpperLimit=Slider(700, range=0..1000),
    Parameter=analysis_results,
    stops=[0: RGB(0, 255, 255), 0.496: RGB(0, 0, 0), 1: RGB(255, 0, 255)])
mesh_colours = MeshColours(Mesh=graft(facade_panels_2), Colours=graft(gradient))

# ----
# maximise sun hours
fytp_2 = FullYear(TimeStep=1, version="1.2.0.60000")
sr = SunRig(NorthVector=Vector(0, 1, 0), Location=L, TimePattern=fytp_2, CutOffElevation=0, method="Sun Rig", version="1.2.0.60000")
sha = SunlightHourAnalysis(
    Run=True,
    SceneObjects=scene_objects,
    SunRig=sr,
    AnalysisPoints=analysis_points_2,
    VisibilityMask="""{
  "Mask1": true,
  "Mask2": true,
  "Mask3": true,
  "Mask4": true,
  "Mask5": true,
  "Mask6": true,
  "Mask7": true,
  "Mask8": true,
  "BitMap": [
    true,
    true,
    true,
    true,
    true,
    true,
    true,
    true
  ]
}""",
    method="Sunlight Hour Analysis",
    version="1.2.0.60000")  # -> Scene, SunlightHours

# ----
# cumulative sun hours per voxel
ma = MassAddition(Input=sha.SunlightHours)  # -> Result, PartialResults
data = Data(simplify(ma.Result))

# ----
# cumulative radiation per voxel
ma_2 = MassAddition(Input=analysis_results)  # -> Result, PartialResults
data_2 = Data(simplify(ma_2.Result))

# ----
# calculate reward
merge = Merge(Data1=data_2, Data2=data)
py3_3 = Python3Script(metrics=merge, path=panel_6, w_rad=radiation_weight, w_sun=sunhours_weight)  # -> out, a; inputs metrics: tree
# ---------- py3_3: Python ----------
import json
import os

output_file = path

# Validate weights
if w_rad is None or w_sun is None:
    print("❌ Missing weight inputs")
    exit()

total_reward = 0.0
valid = True

try:
    for i in range(metrics.BranchCount):
        raw_entry = metrics.Branch(i)
        entry = list(raw_entry)  # ✅ Convert from .NET list to Python list

        if not isinstance(entry, list) or len(entry) < 2:
            print(f"❌ Invalid metric at index {i}: {entry}")
            valid = False
            break

        rad = float(entry[0])
        sun = float(entry[1])
        voxel_reward = (w_rad * rad) + (w_sun * sun)
        total_reward += voxel_reward

except Exception as e:
    print("❌ Error in parsing:", e)
    valid = False

# ✅ Write reward file if all entries were valid
if valid:
    with open(output_file, 'w') as f:
        json.dump({"reward": float(total_reward)}, f)
    print(f"✅ Reward written: {total_reward}")
else:
    print("❌ Reward not written due to error.")
# ---------- end py3_3 ----------

rewardsender = Python3Script(num_steps="12", metrics=merge, w_rad=radiation_weight, w_sun=sunhours_weight, run=toggle)  # -> out, success; inputs num_steps: Int32, w_rad: Double, w_sun: Double, run: Boolean
# ---------- rewardsender: Python ----------
# venv: lichen
import aiohttp
import asyncio

async def poll_for_voxel(session):
    while True:
        async with session.get("http://localhost:5555/emit") as resp:
            emit = await resp.json()
            if emit.get("voxel"):
                async with session.get("http://localhost:5555/env/get_voxel") as voxel_resp:
                    if voxel_resp.ok:
                        voxel_data = (await voxel_resp.json()).get("voxel_data")
                        print(f"Received voxel data: {voxel_data}")
                        return voxel_data
            await asyncio.sleep(0.5)

async def send_reward(session, reward):
    await session.post("http://localhost:5555/env/send_reward", json={"reward": reward})

async def main(reward):
    async with aiohttp.ClientSession() as session:
        i=0
        while i < num_steps:
            total_reward = 0.0
            valid = True

            try:
                for i in range(metrics.BranchCount):
                    raw_entry = metrics.Branch(i)
                    entry = list(raw_entry)  # ✅ Convert from .NET list to Python list

                    if not isinstance(entry, list) or len(entry) < 2:
                        print(f"❌ Invalid metric at index {i}: {entry}")
                        valid = False
                        break

                    rad = float(entry[0])
                    sun = float(entry[1])
                    voxel_reward = (w_rad * rad) + (w_sun * sun)
                    total_reward += voxel_reward

            except Exception as e:
                print("❌ Error in parsing:", e)
                valid = False
            print(f"Sending reward: {reward}")
            await send_reward(session, total_reward)

            i += 1

if __name__ == "__main__":
    if run:
        asyncio.run(main())
# ---------- end rewardsender ----------
panel_7 = Panel(rewardsender.success)
