# Grasshopper definition TEST FacadePanelizationGeometry_00.gh (Grasshopper 1.0.8)

window_facade_spacing_m = Slider(0.1, range=0..0.5)
window_width_m = Slider(3, range=0.5..5)
window_height_m = Slider(2, range=0.5..5)
room_height_m = Slider(3, range=2..5)
room_width_m = Slider(7, range=3..15)
room_depth_m = Slider(10, range=3..15)
placement = Slider(0, range=0..8)
innerfacadelength = Number(room_width_m)
innerfacadeheight = Number(room_height_m)
construct_point = ConstructPoint(XCoordinate=room_width_m, YCoordinate=room_width_m, ZCoordinate=room_height_m)
construct_point_2 = ConstructPoint(XCoordinate=0, YCoordinate=0, ZCoordinate=0)
construct_point_3 = ConstructPoint(XCoordinate=window_width_m, YCoordinate=0, ZCoordinate=window_height_m)
spacingedge = Number(window_facade_spacing_m)
placement_pts = Placement_pts(
    spacingedge=spacingedge,
    innerfacadelength=innerfacadelength,
    innerfacadeheight=innerfacadeheight,
    windowlength=window_width_m,
    windowheight=window_height_m)
box_2pt = Box2Pt(PointA=construct_point_2, PointB=construct_point_3, Plane=PlaneXY(0, 0, 0))
box_2pt_2 = Box2Pt(PointA=construct_point_2, PointB=construct_point, Plane=PlaneXY(0, 0, 0))
deconstruct_brep = DeconstructBrep(Brep=box_2pt_2)  # -> Faces, Edges, Vertices
placement_2 = Number(placement)
list_item = ListItem(List=placement_pts, Index=placement_2, Wrap=True)
og_window = Geometry(box_2pt)
list_item_2 = ListItem(List=deconstruct_brep.Faces, Index=0, Wrap=True)  # -> Item2, Item1, Item
brep_wireframe = BrepWireframe(Brep=box_2pt_2, Density=-1)
move = Move(Geometry=og_window, Motion=list_item)  # -> Geometry, Transform
floor = Geometry(list_item_2.Item2)
facade = Geometry(list_item_2.Item)
custom_preview = CustomPreview(Geometry=brep_wireframe, Material=ColourSwatch(SwatchColor=RGB(0, 0, 0)))
custom_preview_2 = CustomPreview(Geometry=move.Geometry, Material=ColourSwatch(SwatchColor=RGBA(156, 224, 255, 130)))
window = Geometry(move.Geometry)

# ----
# Input panel size (now fixed)
panel_heigth_m_up_and_down = Slider(3, range=1..5, expression="X*0.25")
panel_heigth_m_left_right = Slider(5, range=3..6, expression="X*0.25")
panel_width_m = Slider(0.5, range=0.2..1.2)

# ----
# Define facade parts
window_2 = Geometry(window)
# AGENT PARTS! START FROM HERE
facade_2 = Geometry(facade)
divide_facade = DivideFacade(facade=facade_2, window=window_2)  # -> facade_part_1_2, facade_part_2_2, facade_part_3_2, facade_part_4_2

facade_part_4 = Geometry(divide_facade.facade_part_4_2)
facade_part_2 = Geometry(divide_facade.facade_part_2_2)
flip_curve = FlipCurve(Curve=facade_part_2)  # -> Curve, Flag
flip_curve_2 = FlipCurve(Curve=facade_part_4)  # -> Curve, Flag
facade_part_1 = Geometry(divide_facade.facade_part_1_2)
facade_part_3 = Geometry(divide_facade.facade_part_3_2)
panelization = Panelization(facadepart=facade_part_1, panel_width_m=panel_width_m, panel_height_m=panel_heigth_m_left_right)
panelization_2 = Panelization(facadepart=flip_curve_2.Curve, panel_width_m=panel_width_m, panel_height_m=panel_heigth_m_up_and_down)
panelization_3 = Panelization(facadepart=facade_part_3, panel_width_m=panel_width_m, panel_height_m=panel_heigth_m_up_and_down)
panelization_4 = Panelization(facadepart=flip_curve.Curve, panel_width_m=panel_width_m, panel_height_m=panel_heigth_m_left_right)
panels = Surface(panelization)
panels_2 = Surface(panelization_4)
panels_3 = Surface(panelization_3)
panels_4 = Surface(panelization_2)
merge = Merge(Data1=panels, Data2=panels_2, Data3=panels_3, Data4=panels_4)  # -> flatten(Result)
panels_5 = Surface(merge)

# ----
# Grouping panels
# Area with side length
# Perimeter
panels_6 = Surface(panels_5)
explode = Explode(Curve=panels_6, Recursive=True)  # -> Segments, Vertices
join_curves = JoinCurves(Curves=explode.Segments, Preserve=False)  # -> flatten(Curves)
dimensions = Dimensions(Surface=join_curves)  # -> UDimension, VDimension
area = Area(Geometry=panels_6)  # -> Area, Centroid
areapanels = Data(area.Area)
u_dim = Data(dimensions.UDimension)
v_dim = Data(dimensions.VDimension)
expression = Expression(x=v_dim, y=u_dim, Expression="(x+y)*2")
expression_2 = Expression(x=areapanels, y=v_dim, z=u_dim, Expression="x+(y+z)")
panelperimetersides = Data(expression)
panelareasides = Data(expression_2)

# ----
# Group panels based on dimentions
create_set = CreateSet(List=panelareasides)  # -> Set, Map
area_with_length_of_groups = Panel(create_set.Map)
member_index = MemberIndex(Set=panelareasides, Member=create_set.Set)  # -> Index, Count
mappanelgroups = Data(create_set.Map)
nr_of_panels_per_group = Panel(member_index.Count)
indexpanelgroups = Data(member_index.Index)
countpanelgroups = Data(member_index.Count)

list_item_3 = ListItem(List=indexpanelgroups, Index=0, Wrap=True)  # -> flatten(Item)
list_item_4 = ListItem(List=indexpanelgroups, Index=0, Wrap=True)  # -> flatten(Item)
list_item_5 = ListItem(List=indexpanelgroups, Index=0, Wrap=True)  # -> flatten(Item)
areapanels_2 = Data(areapanels)
v_dimpanels = Data(v_dim)
u_dim_2 = Data(u_dim)
list_item_6 = ListItem(List=areapanels_2, Index=list_item_3, Wrap=True)
list_item_7 = ListItem(List=u_dim_2, Index=list_item_4, Wrap=True)
list_item_8 = ListItem(List=v_dimpanels, Index=list_item_5, Wrap=True)
u_dimpanelgroups = Data(list_item_7)
areapanelgroups = Data(list_item_6)
v_dimpanelgroups = Data(list_item_8)
panel = Panel(list_item_6)
panel_2 = Panel(list_item_7)
panel_3 = Panel(list_item_8)

# ----
# Visualise
mappanelgroups_2 = Data(mappanelgroups)
bounds = Bounds(Numbers=mappanelgroups_2)
deconstruct_domain = DeconstructDomain(Domain=bounds)  # -> Start, End
gradient = Gradient(
    LowerLimit=deconstruct_domain.Start,
    UpperLimit=deconstruct_domain.End,
    Parameter=mappanelgroups_2,
    stops=[0: RGB(243, 57, 0), 0: RGB(236, 27, 60), 0.111: RGB(210, 0, 118), 0.223: RGB(103, 0, 120), 0.36: RGB(39, 72, 161), 0.484: RGB(1, 192, 229), 0.618: RGB(18, 178, 90), 0.729: RGB(79, 186, 8), 0.842: RGB(220, 237, 32), 1: RGB(243, 57, 0), 1: RGB(247, 159, 20)])
panels_7 = Surface(panels_6)
custom_preview_3 = CustomPreview(Geometry=panels_7, Material=gradient)

# ----
# Design Inputs
countpanelgroups_2 = Data(countpanelgroups)
areapanelgroups_2 = Data(areapanelgroups)

# ----
# Input for costs
panel_4 = Panel("10")

# ----
# Window-Wall Ratio (WWR) & Window-Floor Ratio (WFR)
window_3 = Geometry(window_2)
facade_3 = Geometry(facade_2)
floor_2 = Geometry(floor)
area_2 = Area(Geometry=floor_2)  # -> Area, Centroid
area_3 = Area(Geometry=facade_3)  # -> Area, Centroid
area_4 = Area(Geometry=window_3)  # -> Area, Centroid
ratiocalculations = Script(window_area=area_4.Area, facade_area=area_3.Area, floor_area=area_2.Area)  # -> out, wwr, wfr; inputs window_area: Double, facade_area: Double, floor_area: Double
# ---------- ratiocalculations: Python ----------
#Calculate the window to wall ratio
wwr = round((window_area/facade_area), 2)

#Calculate the window to floor ratio
wfr = round((window_area/floor_area), 2)
# ---------- end ratiocalculations ----------
window_to_wall_ratio_wwr = Panel(ratiocalculations.wwr)
wwr = Number(ratiocalculations.wwr)
wfr = Number(ratiocalculations.wfr)
window_to_floor_ratio_wfr = Panel(ratiocalculations.wfr)

# ----
# Calculating design fitness
# Production Cost Calculator
# cost per panel m2 = 24 eu
# groups with less than 3 panels = cost * 1.2
# groups with more than 10 panels = cost * 0.95
cost_calculator = Script(
    group_count=countpanelgroups_2,
    group_area=areapanelgroups_2,
    price_per_m2="24",
    lower_bound_nr_panels="3",
    lower_bound_price_penalty="1.2",
    upper_bound_nr_panels=panel_4,
    upper_bound_price_penalty="0.95")  # -> out, panel_count, unique_panels, groups_few_panels, production_cost, m2_prices_per_group; inputs group_count: list of Int32, group_area: list of Double, price_per_m2: Double, lower_bound_nr_panels: Int32, lower_bound_price_penalty: Double, upper_bound_nr_panels: Int32, upper_bound_price_penalty: Double
# ---------- cost_calculator: Python ----------
# Assuming group_count and group_area are lists of counts and areas for each group respectively
unique_panels = len(group_count)
panel_count = sum(group_count)

total_production_cost = 0
m2_prices_per_group = []
groups_few_panels = 0

for group_nr in range(unique_panels):
    group_count_current = group_count[group_nr]
    group_area_current = group_area[group_nr]
    
    if group_count_current <= lower_bound_nr_panels:
        m2_price = round(price_per_m2 * lower_bound_price_penalty, 2)
        groups_few_panels += 1
    elif group_count_current >= upper_bound_nr_panels:
        m2_price = round(price_per_m2 * upper_bound_price_penalty, 2)
    else:
        m2_price = price_per_m2

    group_price = round(m2_price * group_area_current * group_count_current, 2)
    total_production_cost += group_price
    m2_prices_per_group.append(m2_price)

production_cost = round(total_production_cost,2)

print("Total production cost:", production_cost)
print("m2 price per panel group:", m2_prices_per_group)
print("Number of groups with 3 or fewer panels:", groups_few_panels)
# ---------- end cost_calculator ----------
nrofpanels = Number(cost_calculator.panel_count)
nrofuniquepanels = Number(cost_calculator.unique_panels)
panelgroupsfewpanels = Number(cost_calculator.groups_few_panels)
productioncost = Number(cost_calculator.production_cost)
costperpanelgroup = Number(cost_calculator.m2_prices_per_group)
panel_5 = Panel(nrofuniquepanels)
panel_6 = Panel(panelgroupsfewpanels)
panel_7 = Panel(nrofpanels)
panel_8 = Panel(productioncost)
panel_9 = Panel(costperpanelgroup)

# ==== cluster Panelization
panel_height_m = ClusterInput()
panel_width_m = ClusterInput()
facadepart = ClusterInput()

# ----
# Divide in vertical parts
facadepart_2 = Surface(facadepart)
explode = Explode(Curve=facadepart_2, Recursive=True)  # -> Segments, Vertices
sortlines = SortLines(lines=explode.Segments)  # -> horz_lines, vert_lines
panel_width_m_2 = Number(panel_width_m)
list_item = ListItem(List=sortlines.vert_lines, Index=0, Wrap=True)
item = ListItem(List=sortlines.horz_lines, Index=0, Wrap=True)
length = Length(Curve=list_item)
divdist = DivideDistance(Curve=item, Distance=panel_width_m_2)  # -> Points, Tangents, Parameters

facadepart_3 = Surface(facadepart_2)

srf_cp = SurfaceClosestPoint(Point=divdist.Points, Surface=facadepart_3)  # -> Point, UVPoint, Distance
iso = IsoCurve(Surface=facadepart_3, UVPoint=srf_cp.UVPoint)  # -> UIsocurve, VIsocurve
srfsplit = SurfaceSplit(Surface=facadepart_3, Curves=flatten([iso.UIsocurve, iso.VIsocurve]))

# ----
# Select vertical lines on one side of the panels
explode_2 = Explode(Curve=srfsplit, Recursive=True)  # -> Segments, Vertices
sortlines_2 = SortLines(lines=explode_2.Segments)  # -> horz_lines, vert_lines
curve_middle = CurveMiddle(Curve=sortlines_2.vert_lines)
list_item_2 = ListItem(List=divdist.Points, Index=0, Wrap=True)
closest_point = ClosestPoint(Point=list_item_2, Cloud=curve_middle)  # -> ClosestPoint, CPIndex, Distance
list_item_3 = ListItem(List=sortlines_2.vert_lines, Index=closest_point.CPIndex, Wrap=True)

# ----
# Order vertical lines and panels based on distance
end_points = EndPoints(Curve=flatten(list_item_3))  # -> Start, End
line = Line(StartPoint=list_item_2, EndPoint=end_points.Start)
length_2 = Length(Curve=line)
sort_list = SortList(Keys=length_2, ValuesValuesA=flatten(list_item_3))  # -> Keys, ValuesValuesA
sort_list_2 = SortList(Keys=length_2, ValuesValuesA=srfsplit)  # -> Keys, ValuesValuesA

panel_height_m_2 = Number(panel_height_m)
panel = Panel("""0
1""")
cull_pattern = CullPattern(List=sort_list.ValuesValuesA, CullPattern=invert(panel))
cull_pattern_2 = CullPattern(List=sort_list.ValuesValuesA, CullPattern=panel)

expression = Expression(x=length, y=panel_height_m_2, Expression="-(x-(Round(x/y,0)*y))")

unit_z = UnitZ(Factor=expression)
move = Move(Geometry=cull_pattern, Motion=unit_z)  # -> Geometry, Transform
divdist_2 = DivideDistance(Curve=[move.Geometry, cull_pattern_2], Distance=panel_height_m_2)  # -> Points, Tangents, Parameters

panel_2 = Panel(expression)

cull_pattern_3 = CullPattern(List=sort_list_2.ValuesValuesA, CullPattern=invert(panel))
cull_pattern_4 = CullPattern(List=sort_list_2.ValuesValuesA, CullPattern=panel)
srf_cp_2 = SurfaceClosestPoint(Point=divdist_2.Points, Surface=sort_list_2.ValuesValuesA)  # -> Point, UVPoint, Distance
merge = Merge(Data1=cull_pattern_3, Data2=cull_pattern_4)
iso_2 = IsoCurve(Surface=graft(merge), UVPoint=srf_cp_2.UVPoint)  # -> UIsocurve, VIsocurve
srfsplit_2 = SurfaceSplit(Surface=merge, Curves=flatten([iso_2.UIsocurve, iso_2.VIsocurve]))
panels = Surface(srfsplit_2)

panels_2 = ClusterOutput(panels)

# ==== cluster DivideFacade
window = ClusterInput()
facade = ClusterInput()
window_2 = Geometry(window)
facade_2 = Geometry(facade)

# ----
# Window points
deconstruct_brep = DeconstructBrep(Brep=window_2)  # -> Faces, Edges, Vertices
list_item = ListItem(List=deconstruct_brep.Vertices, Index=0, Wrap=True)  # -> Item1, Item, Item1_2

# ----
# Facade points
deconstruct_brep_2 = DeconstructBrep(Brep=facade_2)  # -> Faces, Edges, Vertices
list_item_2 = ListItem(List=deconstruct_brep_2.Vertices, Index=0, Wrap=True)  # -> Item, Item1, Item2

deconstruct = Deconstruct(Point=list_item_2.Item2)  # -> XComponent, YComponent, ZComponent
deconstruct_2 = Deconstruct(Point=list_item.Item1_2)  # -> XComponent, YComponent, ZComponent
deconstruct_3 = Deconstruct(Point=list_item.Item)  # -> XComponent, YComponent, ZComponent
construct_point = ConstructPoint(XCoordinate=deconstruct_2.XComponent, YCoordinate=0, ZCoordinate=deconstruct.ZComponent)
construct_point_2 = ConstructPoint(XCoordinate=deconstruct_3.XComponent, YCoordinate=0, ZCoordinate=0)
xz_plane = XZPlane(Origin=Point(0, 0, 0))

rectangle_2pt = Rectangle2Pt(Plane=xz_plane, PointA=list_item_2.Item2, PointB=construct_point_2, Radius=0)  # -> Rectangle, Length
rectangle_2pt_2 = Rectangle2Pt(Plane=xz_plane, PointA=list_item_2.Item1, PointB=construct_point, Radius=0)  # -> Rectangle, Length
rectangle_2pt_3 = Rectangle2Pt(Plane=xz_plane, PointA=list_item.Item1_2, PointB=construct_point_2, Radius=0)  # -> Rectangle, Length
rectangle_2pt_4 = Rectangle2Pt(Plane=xz_plane, PointA=list_item.Item1, PointB=construct_point, Radius=0)  # -> Rectangle, Length
facade_part_2 = Geometry(rectangle_2pt_2.Rectangle)
facade_part_1 = Geometry(rectangle_2pt.Rectangle)
facade_part_3 = Geometry(rectangle_2pt_3.Rectangle)
facade_part_4 = Geometry(rectangle_2pt_4.Rectangle)
facade_part_2_2 = ClusterOutput(facade_part_2)
facade_part_1_2 = ClusterOutput(facade_part_1)
facade_part_3_2 = ClusterOutput(facade_part_3)
facade_part_4_2 = ClusterOutput(facade_part_4)

# ==== cluster Placement_pts
innerfacadelength = ClusterInput()
innerfacadeheight = ClusterInput()
windowlength = ClusterInput()
windowheight = ClusterInput()
spacingedge = ClusterInput()

# ----
# Window movement area
expression = Expression(x=innerfacadeheight, y=windowheight, z=spacingedge, Expression="x-y-z")
expression_2 = Expression(x=innerfacadelength, y=windowlength, z=spacingedge, Expression="x-y-z")
construct_point = ConstructPoint(XCoordinate=spacingedge, YCoordinate=0, ZCoordinate=spacingedge)
construct_point_2 = ConstructPoint(XCoordinate=expression_2, YCoordinate=0, ZCoordinate=expression)
box_2pt = Box2Pt(PointA=construct_point, PointB=construct_point_2, Plane=PlaneXY(0, 0, 0))

# ----
# Corner points
deconstruct_brep = DeconstructBrep(Brep=box_2pt)  # -> Faces, Edges, Vertices
list_item = ListItem(List=deconstruct_brep.Vertices, Index=0, Wrap=True)  # -> Item, Item1, Item2, Item3

# ----
# Move points
# Centre
area = Area(Geometry=box_2pt)  # -> Area, Centroid

# ----
# Midline points
curve_middle = CurveMiddle(Curve=deconstruct_brep.Edges)
list_item_2 = ListItem(List=curve_middle, Index=0, Wrap=True)  # -> Item, Item1, Item2, Item3

merge = Merge(
    Data1=area.Centroid,
    Data2=list_item.Item,
    Data3=list_item_2.Item,
    Data4=list_item.Item1,
    Data5=list_item_2.Item1,
    Data6=list_item.Item2,
    Data7=list_item_2.Item2,
    Data8=list_item.Item3,
    Data9=list_item_2.Item3)  # -> flatten(Result)
movepts = Data(merge)

point = Point(merge)
movepts_2 = ClusterOutput(movepts)

# ==== cluster SortLines
lines = ClusterInput()

curvepoint = PointOnCurve(lines, parameter=1)
curvepoint_2 = PointOnCurve(lines, parameter=0)
pdecon = Deconstruct(Point=curvepoint)  # -> XComponent, YComponent, ZComponent
pdecon_2 = Deconstruct(Point=curvepoint_2)  # -> XComponent, YComponent, ZComponent
subtraction = Subtraction(A=pdecon_2.ZComponent, B=pdecon.ZComponent)
similar = Similarity(FirstNumber=subtraction, SecondNumber="0", Threshold=0.1)  # -> Similarity, AbsoluteDifference
dispatch = Dispatch(List=lines, DispatchPattern=similar.Similarity)  # -> ListA, ListB

horz_lines = ClusterOutput(dispatch.ListA)
vert_lines = ClusterOutput(dispatch.ListB)
