# Grasshopper definition TileEvaluator.gh (Grasshopper 1.0.8)

face_plane = GetPlane(AtLeast=1, AtMost=1, Realtime=True, TreeAccess=True)
tile_w = GetNumber(AtLeast=1, AtMost=1, Maximum=1.797693135e+308, Minimum=-1.797693135e+308, TreeAccess=True)
tile_h = GetNumber(AtLeast=1, AtMost=1, Maximum=1.797693135e+308, Minimum=-1.797693135e+308, TreeAccess=True)
archetype_id = GetInteger(AtLeast=1, AtMost=1, Maximum=2147483647, Minimum=-2147483648, TreeAccess=True)
frame_t = GetNumber(AtLeast=1, AtMost=1, Maximum=1.797693135e+308, Minimum=-1.797693135e+308, TreeAccess=True)
bar_t = GetNumber(AtLeast=1, AtMost=1, Maximum=1.797693135e+308, Minimum=-1.797693135e+308, TreeAccess=True)
ring_t = GetNumber(AtLeast=1, AtMost=1, Maximum=1.797693135e+308, Minimum=-1.797693135e+308, TreeAccess=True)
corner_id = GetInteger(AtLeast=1, AtMost=1, Maximum=2147483647, Minimum=-2147483648, TreeAccess=True)
theta_deg = GetNumber(AtLeast=1, AtMost=1, Maximum=1.797693135e+308, Minimum=-1.797693135e+308, TreeAccess=True)
python_3_script = Python3Script(
    face_plane=face_plane,
    tile_w=tile_w,
    tile_h=tile_h,
    archetype_id=archetype_id,
    frame_t=frame_t,
    bar_t=bar_t,
    ring_t=ring_t,
    corner_id=corner_id,
    theta_deg=theta_deg)  # -> metrics_json, signature_raw, preview_crv; inputs face_plane: Plane, tile_w: Double, tile_h: Double, archetype_id: Int32, frame_t: Double, bar_t: Double, ring_t: Double, corner_id: Int32, theta_deg: Double
# ---------- python_3_script: Python ----------
import math, json
import Rhino.Geometry as rg

# ---------- helpers ----------
def clamp(x, lo, hi): return max(lo, min(hi, x))
def rr(x, n): return round(float(x), n)

def valid_inputs(w,h,ft,bt,rt):
    if w is None or h is None:                return False, "missing size"
    if w <= 0 or h <= 0:                      return False, "non-positive size"
    if ft is None or bt is None or rt is None:return False, "missing thickness"
    if ft < 0 or bt < 0 or rt < 0:            return False, "negative thickness"
    if 2*ft >= min(w,h):                      return False, "frame too thick"
    return True, ""

def make_rect_xy(cx, cy, ww, hh):
    rx = rg.Interval(cx-ww/2.0, cx+ww/2.0)
    ry = rg.Interval(cy-hh/2.0, cy+hh/2.0)
    return rg.Rectangle3d(rg.Plane.WorldXY, rx, ry).ToNurbsCurve()

def xform_to_face(curves, face_plane, theta_deg):
    # rotate in local XY by theta, then orient XY->face_plane
    rot = rg.Transform.Rotation(math.radians(float(theta_deg)), rg.Point3d(0,0,0))
    xform = rg.Transform.PlaneToPlane(rg.Plane.WorldXY, face_plane)
    out=[]
    for c in curves:
        cc = c.DuplicateCurve()
        cc.Transform(rot); cc.Transform(xform)
        out.append(cc)
    return out

# ---------- read / sanitize inputs ----------
w   = float(tile_w)
h   = float(tile_h)
ft  = float(frame_t)
bt  = float(bar_t)
rt  = float(ring_t)
aid = int(archetype_id)
cid = int(corner_id) % 4
th  = float(theta_deg)

# defaults so outputs are always defined
preview = []
panel_area_m2 = 0.0
cut_length_m  = 0.0
void_ratio    = 1.0
is_valid      = False
signature_raw = ""

ok, msg = valid_inputs(w,h,ft,bt,rt)

if ok:
    # ---------- base numbers (cm) ----------
    outer_perim = 2.0*(w+h)
    inner_w = w - 2.0*ft
    inner_h = h - 2.0*ft
    inner_perim = 2.0*(inner_w + inner_h)
    rect_area = w*h
    built_area = 0.0
    ring_cut = 0.0

    # ---------- archetypes ----------
    if aid == 0:  # SOLID
        built_area = rect_area
        cut_len_cm = outer_perim
        preview += xform_to_face([ make_rect_xy(0,0,w,h) ], face_plane, th)

    elif aid == 2:  # DIAMOND (+): frame + horizontal + vertical bars
        a = max(0.0, inner_w); b = max(0.0, inner_h)
        built_area = rect_area - (inner_w*inner_h)                   # frame
        bars_area  = max(0.0, a*bt + b*bt - bt*bt)                   # two bars minus overlap
        built_area += bars_area
        cut_len_cm = outer_perim + inner_perim + 2*(2*(a+bt) + 2*(b+bt))
        preview += xform_to_face([
            make_rect_xy(0,0,w,h),
            make_rect_xy(0,0,inner_w,inner_h),
            make_rect_xy(0,0,a,bt),
            make_rect_xy(0,0,bt,b)
        ], face_plane, th)

    elif aid == 1:  # CROSS (X): frame + 2 diagonal bars
        a = max(0.0, min(inner_w, inner_h))
        diag = math.sqrt(2.0)*a
        built_area = rect_area - (inner_w*inner_h)
        bars_area  = max(0.0, 2.0*diag*bt - bt*bt)
        built_area += bars_area
        cut_len_cm = outer_perim + inner_perim + 2*(2*(diag+bt))
        r1 = make_rect_xy(0,0,diag,bt); r2 = make_rect_xy(0,0,diag,bt)
        r1.Transform(rg.Transform.Rotation(math.radians(45),  rg.Point3d(0,0,0)))
        r2.Transform(rg.Transform.Rotation(math.radians(-45), rg.Point3d(0,0,0)))
        preview += xform_to_face([
            make_rect_xy(0,0,w,h),
            make_rect_xy(0,0,inner_w,inner_h),
            r1, r2
        ], face_plane, th)

    elif aid == 3:  # QUARTER-RING: frame + annulus quarter at corner
        built_area = rect_area - (inner_w*inner_h)
        a = min(inner_w, inner_h)
        if a > 0:
            R = a/2.0
            rt = clamp(rt, 0.0, R-0.01)
            r_in = R - rt
            ring_area = 0.25 * math.pi * (R*R - r_in*r_in)
            ring_cut  = (math.pi/2.0)*(R + r_in) + 2.0*rt
            built_area += ring_area
        cut_len_cm = outer_perim + inner_perim + ring_cut
        # preview: outer + inner + ring edges
        sx = -1 if (cid in (0,3)) else +1
        sy = -1 if (cid in (0,1)) else +1
        cx = sx*(inner_w/2.0); cy = sy*(inner_h/2.0)
        crvs = [ make_rect_xy(0,0,w,h), make_rect_xy(0,0,inner_w,inner_h) ]
        if a > 0 and rt > 0:
            arc_outer = rg.Arc(rg.Circle(rg.Point3d(cx,cy,0), R), math.pi/2.0).ToNurbsCurve()
            arc_inner = rg.Arc(rg.Circle(rg.Point3d(cx,cy,0), R-rt), math.pi/2.0).ToNurbsCurve()
            p1 = rg.Point3d(cx+sx*R, cy, 0);     p2 = rg.Point3d(cx+sx*(R-rt), cy, 0)
            p3 = rg.Point3d(cx, cy+sy*R, 0);     p4 = rg.Point3d(cx, cy+sy*(R-rt), 0)
            rad1 = rg.Line(p1,p2).ToNurbsCurve(); rad2 = rg.Line(p3,p4).ToNurbsCurve()
            crvs += [arc_outer, arc_inner, rad1, rad2]
        preview += xform_to_face(crvs, face_plane, th)

    else:
        # Fallback → Solid
        built_area = rect_area
        cut_len_cm = outer_perim
        preview += xform_to_face([ make_rect_xy(0,0,w,h) ], face_plane, th)

    # ---------- metrics ----------
    panel_area_m2 = built_area / 10000.0     # cm² → m²
    cut_length_m  = cut_len_cm / 100.0       # cm  → m
    void_ratio    = max(0.0, min(1.0, 1.0 - (built_area / rect_area)))

    is_valid = True
    if inner_w <= 0 or inner_h <= 0:                             is_valid = False
    if aid in (1,2) and bt <= 0:                                 is_valid = False
    if aid == 3 and (rt <= 0 or rt >= min(inner_w,inner_h)/2.0): is_valid = False

    signature_raw = "{}|{}|{}|{}|{}|{}|{}|{}".format(
        aid, rr(w,1), rr(h,1), rr(ft,1), rr(bt,1), rr(rt,1), cid, rr(th,1)
    )
else:
    # invalid inputs → keep defaults (zeros) and empty preview/signature
    pass

# ---------- pack JSON & set outputs ----------
data = {
    "is_valid": bool(is_valid),
    "panel_area": float(rr(panel_area_m2, 4)),
    "cut_length": float(rr(cut_length_m, 4)),
    "void_ratio": float(rr(void_ratio, 4)),
    "fold_count": 0,
    "signature_raw": signature_raw
}
metrics_json = json.dumps(data)
preview_crv  = preview
# ---------- end python_3_script ----------
context_print = ContextPrint(Metrics_json=python_3_script.metrics_json)
context_print_2 = ContextPrint(Signature_raw=python_3_script.signature_raw)
c_bake = ContextBake(Preview_crv=python_3_script.preview_crv)
