# Grasshopper definition Paneling cost reward.gh (Grasshopper 1.0.8)
# plug-ins: opennest_2 Info, Hops

# ---- group: hops input
panel = Panel("""{"voxels": [[[1, 1, 0, 1, 1], [1, 0, 1, 1, 0], [1, 1, 1, 1, 1], [1, 1, 1, 1, 0], [0, 1, 0, 0, 0]], [[0, 1, 0, 0, 1], [1, 0, 0, 1, 
0], [1, 1, 1, 0, 1], [1, 0, 1, 1, 0], [0, 1, 1, 0, 0]], [[0, 1, 1, 0, 1], [1, 1, 1, 1, 0], [0, 1, 1, 0, 0], [1, 0, 1, 1, 0], [0,  
0, 1, 0, 0]], [[1, 1, 0, 0, 0], [0, 1, 1, 0, 0], [1, 1, 0, 0, 0], [0, 1, 1, 0, 0], [1, 1, 0, 0, 0]], [[1, 1, 0, 0, 0], [0, 1, 1,  
0, 0], [1, 1, 0, 0, 0], [0, 1, 1, 0, 0], [1, 1, 0, 0, 0]]]}""")
voxel_json = GetString(panel, AtLeast=1, AtMost=1, Prompt="json string of voxel positions", TreeAccess=True)

# ----
py3 = Python3Script(voxels_json=voxel_json)  # -> out, a; inputs voxels_json: String
# ---------- py3: Python ----------
# venv: lichen
import Rhino.Geometry as rg
import json

voxels = json.loads(voxels_json)['voxels']
boxes = []
print(voxels)
size = len(voxels)
for x in range(size):
    for y in range(size):
        for z in range(size):
            if voxels[x][y][z] == 1:
                pt1 = rg.Point3d(x, y, z)
                pt2 = rg.Point3d(x + 1, y + 1, z + 1)
                bbox = rg.BoundingBox(pt1, pt2)
                boxes.append(rg.Box(bbox))

# Output: list of voxel Boxes
a = boxes
# ---------- end py3 ----------
geo = Geometry(flatten(py3.a))
debrep = DeconstructBrep(Brep=geo)  # -> Faces, Edges, Vertices
area = Area(Geometry=debrep.Faces)  # -> Area, Centroid
deconstruct = Deconstruct(Point=area.Centroid)  # -> XComponent, YComponent, ZComponent
sort_list = SortList(Keys=deconstruct.XComponent, ValuesValuesA=debrep.Faces)  # -> Keys, reverse(ValuesValuesA)
list_item = ListItem(List=sort_list.ValuesValuesA, Index=0, Wrap=True)  # -> flatten(Item)
evalsrf = EvaluateSurface(Surface=reparameterize(debrep.Faces), Point="1,1")  # -> Point, Normal, UDirection, VDirection, Frame
brep_join = BrepJoin(Breps=list_item)  # -> Breps, Closed
devec = DeconstructVector(Vector=evalsrf.Normal)  # -> XComponent, YComponent, ZComponent
area_2 = Area(Geometry=brep_join.Breps)  # -> Area, Centroid
equals = Equality(FirstNumber=devec.ZComponent, SecondNumber="0")  # -> Equality, Inequality
list_item_2 = ListItem(List=brep_join.Breps, Index="10", Wrap=True)
dispatch = Dispatch(List=debrep.Faces, DispatchPattern=equals.Equality)  # -> ListA, ListB
deconstruct_2 = Deconstruct(Point=area_2.Centroid)  # -> XComponent, YComponent, ZComponent
faces = Brep(flatten(dispatch.ListA))

# ----
# Reward Weight
number_slider = Slider(1, range=0..1)
cols_min = GetNumber(number_slider, AtLeast=1, AtMost=1, Maximum=1.797693135e+308, Minimum=-1.797693135e+308, TreeAccess=False)
cols_max = GetNumber(Slider(2, range=0..10), AtLeast=1, AtMost=1, Maximum=1.797693135e+308, Minimum=-1.797693135e+308, TreeAccess=False)
rows_min = GetNumber(Slider(1, range=0..1), AtLeast=1, AtMost=1, Maximum=1.797693135e+308, Minimum=-1.797693135e+308, TreeAccess=False)
rows_max = GetNumber(Slider(3, range=0..10), AtLeast=1, AtMost=1, Maximum=1.797693135e+308, Minimum=-1.797693135e+308, TreeAccess=False)
python_3_script = Python3Script(
    Faces=faces,
    cols_min=cols_min,
    cols_max=cols_max,
    rows_min=rows_min,
    rows_max=rows_max,
    alpha=Slider(10, range=0..10),
    seed=Slider(0, range=0..10))  # -> tiles, flatten(outlines), metrics_json, signature_raw, preview_crv; inputs Faces: list of Brep
# ---------- python_3_script: Python ----------
import Rhino.Geometry as rg
import rhinoscriptsyntax as rs
import System, random, json

# Inputs (GH): Faces (Tree/List/Single), cols_min, cols_max, rows_min, rows_max, alpha, seed
tiles = []
outlines = []
metrics_json = ""
signature_raw = ""
preview_crv = []
signature_tile_params = []  # rows of numbers per tile

# ----------------- helpers -----------------
def iterate_all(x):
    """Yield every item from a Tree, list, or single value."""
    if x is None:
        return
    # DataTree?
    try:
        for p in x.Paths:
            for it in x.Branch(p):
                yield it
        return
    except Exception:
        pass
    # List?
    if hasattr(x, "__iter__") and not isinstance(x, (rg.Brep, rg.Surface, rg.BrepFace, System.Guid)):
        for it in x:
            yield it
        return
    # Single
    yield x

def faces_from(g):
    """Yield every BrepFace from Brep/Surface/BrepFace/GUID."""
    if isinstance(g, System.Guid):
        b = rs.coercebrep(g)
        if b:
            for f in b.Faces:
                yield f
            return
        s = rs.coercesurface(g)
        if s:
            b = s.ToBrep()
            if b:
                for f in b.Faces:
                    yield f
        return
    if isinstance(g, rg.BrepFace):
        yield g; return
    if isinstance(g, rg.Surface):
        b = g.ToBrep()
        if b:
            for f in b.Faces:
                yield f
        return
    if isinstance(g, rg.Brep):
        for f in g.Faces:
            yield f
        return

def dirichlet_breaks(n, alpha, rnd):
    """Return normalized [0..1] breakpoints (len = n+1) for n segments."""
    if n <= 0:
        return [0.0, 1.0]
    seg = [rnd.gammavariate(alpha, 1.0) for _ in range(n)]
    s = sum(seg) or 1.0
    brk = [0.0]; acc = 0.0
    for w in seg:
        acc += w / s
        brk.append(acc)
    brk[-1] = 1.0
    return brk

def map_norm_to_domain(t, dom):
    """Map normalized t in [0,1] to a Rhino Interval domain (supports reversed)."""
    return dom.T0 + t * (dom.T1 - dom.T0)

# ----------------- safe inputs -----------------
def safe_int(v, d): 
    try: return int(v)
    except: return d
def safe_float(v, d):
    try: return float(v)
    except: return d

cols_min = max(1, safe_int(cols_min, 3))
cols_max = max(cols_min, safe_int(cols_max, cols_min))
rows_min = max(1, safe_int(rows_min, 2))
rows_max = max(rows_min, safe_int(rows_max, rows_min))
alpha    = max(0.05, safe_float(alpha, 1.0))
seed     = safe_int(seed, 0)
rnd = random.Random(seed)

# ----------------- collect all faces -----------------
allF = []
for g in iterate_all(Faces):
    for f in faces_from(g):
        allF.append(f)

if not allF:
    metrics_json = json.dumps({"error":"no faces found"})
else:
    # ---------- build ONE global pattern (normalized) ----------
    ncols = rnd.randint(cols_min, cols_max)
    U_norm = dirichlet_breaks(ncols, alpha, rnd)  # len ncols+1

    V_norm_per_col = []
    rows_per_column = []
    for _ in range(ncols):
        nrows = rnd.randint(rows_min, rows_max)
        rows_per_column.append(nrows)
        V_norm_per_col.append(dirichlet_breaks(nrows, alpha, rnd))  # each len nrows+1

    # ---------- apply the SAME pattern to every face ----------
    for face_id, face in enumerate(allF):
        du, dv = face.Domain(0), face.Domain(1)
        amp_face = rg.AreaMassProperties.Compute(face)
        face_area = amp_face.Area if amp_face else 0.0

        for i in range(ncols):
            u0n, u1n = U_norm[i], U_norm[i+1]
            u0 = map_norm_to_domain(u0n, du)
            u1 = map_norm_to_domain(u1n, du)

            Vn = V_norm_per_col[i]
            nrows_this_col = len(Vn) - 1

            for j in range(nrows_this_col):
                v0n, v1n = Vn[j], Vn[j+1]
                v0 = map_norm_to_domain(v0n, dv)
                v1 = map_norm_to_domain(v1n, dv)

                # create tile
                cell = face.Trim(rg.Interval(u0, u1), rg.Interval(v0, v1))
                if cell:
                    tiles.append(cell)
                    # outline for preview
                    p0 = face.PointAt(u0, v0); p1 = face.PointAt(u1, v0)
                    p2 = face.PointAt(u1, v1); p3 = face.PointAt(u0, v1)
                    crv = rg.PolylineCurve([p0, p1, p2, p3, p0])
                    outlines.append(crv)

                    amp = rg.AreaMassProperties.Compute(cell)
                    tile_area = amp.Area if amp else 0.0

                    # numeric row for this tile
                    row = [
                        float(face_id),             # 0 face_id
                        float(tile_area),           # 1 tile_area
                        float(face_area),           # 2 face_area
                        float(ncols),               # 3 ncols
                        float(nrows_this_col),      # 4 nrows in this column
                        float(i),                   # 5 col_id
                        float(j),                   # 6 row_id
                        float(u0n), float(u1n),     # 7,8 u0_norm, u1_norm
                        float(v0n), float(v1n)      # 9,10 v0_norm, v1_norm
                    ]
                    signature_tile_params.append(row)

    # ---------- metrics ----------
    areas = []
    for b in tiles:
        amp = rg.AreaMassProperties.Compute(b)
        if amp: areas.append(amp.Area)
    a_min = min(areas) if areas else 0.0
    a_max = max(areas) if areas else 0.0
    a_avg = (sum(areas) / len(areas)) if areas else 0.0
    a_var = (sum((a - a_avg)**2 for a in areas) / len(areas)) if areas else 0.0
    a_std = a_var**0.5

    metrics = {
        "faces_processed": len(allF),
        "tiles": len(tiles),
        "area_min": a_min,
        "area_max": a_max,
        "area_avg": a_avg,
        "area_std": a_std,
        "cols": ncols,
        "rows_per_column": rows_per_column,
        "seed": seed,
        "alpha": alpha
    }
    metrics_json = json.dumps(metrics, separators=(',',':'))

    # ---------- signature (pattern fingerprint) ----------
    signature_raw_dict = {
        "seed": seed,
        "alpha": alpha,
        "cols": ncols,
        "U_norm": U_norm,                   # column cuts (normalized)
        "V_norm_per_col": V_norm_per_col    # list of row cuts per column (normalized)
    }
    signature_raw = json.dumps(signature_raw_dict, separators=(',',':'))

# ---------- preview ----------
preview_crv = outlines[:]
# ---------- end python_3_script ----------

sort_list_2 = SortList(Keys=deconstruct_2.XComponent, ValuesValuesA=brep_join.Breps)  # -> Keys, reverse(ValuesValuesA)
list_item_3 = ListItem(List=sort_list_2.ValuesValuesA, Index=0, Wrap=True)  # -> flatten(Item)

# ----
# layout generator
number_slider_2 = Slider(0.3, range=0..1)
xy_plane = XYPlane(Origin=Point(0, 0, 0))
python_3_script_2 = Python3Script(
    face_plane=xy_plane,
    facade_w=Slider(295, range=0..1000),
    facade_h=Slider(420, range=0..1000),
    baseSize=Slider(30, range=0..100),
    sizes_text="1,2,3,5,8",
    seed=Slider(1, range=0..1),
    small_bias=number_slider_2)  # -> out, tile_planes, tile_w, tile_h, span, i_idx, j_idx, corner_id_suggest, rect_preview
# ---------- python_3_script_2: Python ----------
import random
from math import floor
import Rhino.Geometry as rg

# inputs:
# face_plane: rg.Plane
# facade_w, facade_h, baseSize: float (cm)
# sizes_text: str like "1,2,3,5,8"
# seed: int
# small_bias: 0..1

# outputs to define:
tile_planes, tile_w, tile_h, span, i_idx, j_idx = [], [], [], [], [], []
corner_id_suggest, rect_preview = [], []

# grid in base cells
nx = int(floor(facade_w / baseSize))
ny = int(floor(facade_h / baseSize))
if nx <= 0 or ny <= 0: 
    raise ValueError("facade size too small for baseSize")

# parse sizes, largest first
S = [int(s.strip()) for s in sizes_text.split(",") if s.strip().isdigit()]
S = sorted(set(S), reverse=True)
if not S: S = [1,2,3,5,8]
random.seed(int(seed))

used = [[False]*nx for _ in range(ny)]

def fits(i, j, s):
    if i + s > nx or j + s > ny: return False
    for jj in range(j, j+s):
        for ii in range(i, i+s):
            if used[jj][ii]: return False
    return True

def mark(i, j, s):
    for jj in range(j, j+s):
        for ii in range(i, i+s):
            used[jj][ii] = True

# scan top->bottom, left->right (Y first so visuals feel natural)
for j in range(ny):
    for i in range(nx):
        if used[j][i]: 
            continue
        chosen = None
        # choose largest that fits
        for s in S:
            if fits(i, j, s):
                chosen = s
                # smallness bias: sometimes step down to a smaller one that also fits
                idx = S.index(s)
                while random.random() < max(0.0, min(1.0, small_bias)) and idx < len(S)-1:
                    s2 = S[idx+1]
                    if fits(i, j, s2):
                        chosen = s2
                        idx += 1
                    else:
                        break
                break
        if chosen is None:
            # fallback: fill with 1 if possible
            if fits(i, j, 1): 
                chosen = 1
            else:
                continue

        mark(i, j, chosen)

        w = chosen * baseSize
        h = w
        # local center of this tile relative to face_plane origin (facade center)
        cx = -facade_w/2.0 + (i + chosen/2.0) * baseSize
        cy = -facade_h/2.0 + (j + chosen/2.0) * baseSize

        # plane at tile center, same axes as facade plane
        origin = face_plane.PointAt(cx, cy)
        tp = rg.Plane(origin, face_plane.XAxis, face_plane.YAxis)

        tile_planes.append(tp)
        tile_w.append(w); tile_h.append(h)
        span.append(chosen)
        i_idx.append(i); j_idx.append(j)

        # corner id suggestion for quarter‑rings so 2x2 blocks assemble circles
        # pattern by cell parity (works even when spans mix):
        # (even,even)->0, (odd,even)->1, (odd,odd)->2, (even,odd)->3
        cid = (i % 2) + 2 * (j % 2)
        corner_id_suggest.append(cid)

        # rectangle preview (in face_plane space)
        rx = rg.Interval(cx - w/2.0, cx + w/2.0)
        ry = rg.Interval(cy - h/2.0, cy + h/2.0)
        rect = rg.Rectangle3d(face_plane, rx, ry)
        rect_preview.append(rect.ToNurbsCurve())
# ---------- end python_3_script_2 ----------

# ----
# tile context
python_3_script_3 = Python3Script(
    tile_planes=python_3_script_2.tile_planes,
    tile_w=python_3_script_2.tile_w,
    tile_h=python_3_script_2.tile_h,
    corner_id_suggest=python_3_script_2.corner_id_suggest)  # -> out, tile_ctx_json, count; disabled
# ---------- python_3_script_3: Python ----------
import json
import Rhino.Geometry as rg
import System.IO as IO

# ---------- helpers ----------
def flatten(xs):
    """Return a flat list. If xs is a single item (e.g., float), wrap it."""
    if xs is None:
        return []
    if not isinstance(xs, (list, tuple)):
        return [xs]
    out = []
    for x in xs:
        if isinstance(x, (list, tuple)):
            out.extend(flatten(x))
        else:
            out.append(x)
    return out

def mid(iv):
    try: return (iv.T0 + iv.T1) * 0.5
    except: return 0.5

def coerce_plane(obj):
    """Try to obtain a Plane from several geometry types."""
    # Plane
    if isinstance(obj, rg.Plane):
        return True, rg.Plane(obj)

    # Rectangle3d
    if isinstance(obj, rg.Rectangle3d):
        return True, rg.Plane(obj.Plane)

    # Planar curve
    if isinstance(obj, rg.Curve):
        ok, pl = obj.TryGetPlane(1e-6)
        if ok: return True, pl
        bb = obj.GetBoundingBox(True)
        if bb.IsValid:
            p = bb.Center
            return True, rg.Plane(p, rg.Vector3d.ZAxis)

    # Surface
    if isinstance(obj, rg.Surface):
        ok, pl = obj.TryGetPlane()
        if ok: return True, pl
        try:
            u = mid(obj.Domain(0)); v = mid(obj.Domain(1))
            ok, pl = obj.FrameAt(u, v)
            if ok: return True, pl
        except: pass

    # Brep (use first face)
    if isinstance(obj, rg.Brep) and obj.Faces.Count > 0:
        face = obj.Faces[0]
        ok, pl = face.TryGetPlane()
        if ok: return True, pl
        try:
            pt = face.PointAt(0.5, 0.5)
            n  = face.NormalAt(0.5, 0.5)
            if not n.IsZero:
                n.Unitize()
                return True, rg.Plane(pt, n)
        except: pass

    # Mesh: fit plane to vertices
    if isinstance(obj, rg.Mesh) and obj.Vertices.Count >= 3:
        pts = [rg.Point3d(v.X, v.Y, v.Z) for v in obj.Vertices]
        ok, pl = rg.Plane.FitPlaneToPoints(pts)
        if ok: return True, pl

    return False, None

def plane_to_dict(p):
    return {
        "origin":[p.OriginX, p.OriginY, p.OriginZ],
        "xaxis":[p.XAxis.X, p.XAxis.Y, p.XAxis.Z],
        "yaxis":[p.YAxis.X, p.YAxis.Y, p.YAxis.Z],
        "zaxis":[p.ZAxis.X, p.ZAxis.Y, p.ZAxis.Z]
    }

def as_list_num(xs, cast=float):
    return [cast(x) for x in flatten(xs)]

# ---------- read & sanitize inputs ----------
planes  = flatten(tile_planes)
ws      = as_list_num(tile_w, float)
hs      = as_list_num(tile_h, float)
corners = as_list_num(corner_id_suggest, int)

n = min(len(planes), len(ws), len(hs))
ctxs = []

for k in range(n):
    ok, pl = coerce_plane(planes[k])
    if not ok:
        # skip items we can't coerce to a plane
        continue

    corner = corners[k] if k < len(corners) else 0

    ctxs.append({
        "id": int(k),
        "plane": plane_to_dict(pl),
        "bbox_w": float(ws[k]),
        "bbox_h": float(hs[k]),
        "corner_id": int(corner)
    })

tile_ctx_json = json.dumps(ctxs, indent=2)
count = len(ctxs)

# ---------- optional save ----------
try:
    if save_path and str(save_path).strip():
        IO.File.WriteAllText(str(save_path), tile_ctx_json)
except Exception as e:
    # If you want to debug saving issues, uncomment:
    # print("Save error:", e)
    pass
# ---------- end python_3_script_3 ----------

# ----
# archetype + metrics
number_slider_3 = Slider(0, range=0..3)  # disabled
number_slider_4 = Slider(6, range=0..10)  # disabled
number_slider_5 = Slider(5, range=0..10)  # disabled
number_slider_6 = Slider(6, range=0..10)  # disabled
number_slider_7 = Slider(0, range=0..90)  # disabled
hops = Hops(
    Face_plane=python_3_script_2.tile_planes,
    Tile_w=python_3_script_2.tile_w,
    Tile_h=python_3_script_2.tile_h,
    Archetype_id=number_slider_3,
    Frame_t=number_slider_4,
    Bar_t=number_slider_5,
    Ring_t=number_slider_6,
    Corner_id=python_3_script_2.corner_id_suggest,
    Theta_deg=number_slider_7,
    CacheResultsInMemory=True,
    CacheSolveResults=True,
    RemoteDefinitionLocation="C:\Users\user\Desktop\VS\RL_Voxel-Agent_PPO_V1\TileEvaluator.gh",
    RemoteSolveVersion=(0, 1, 0),
    ShowInput_Enabled=False,
    ShowInput_Path=False,
    SynchronousSolve=True)  # -> Metrics_json, Signature_raw, flatten(Preview_crv); disabled

# ----
# archetype + metrics
number_slider_8 = Slider(0, range=0..3)
python_3_script_4 = Python3Script(
    face_plane=python_3_script_2.tile_planes,
    tile_w=python_3_script_2.tile_w,
    tile_h=python_3_script_2.tile_h,
    archetype_id=number_slider_8,
    frame_t=Slider(4, range=0..10),
    bar_t=Slider(3, range=0..10),
    ring_t=Slider(3, range=0..10),
    corner_id=python_3_script_2.corner_id_suggest,
    theta_deg=Slider(0, range=0..90))  # -> metrics_json, signature_raw, flatten(preview_crv)
# ---------- python_3_script_4: Python ----------
import math, json
import Rhino.Geometry as rg

# ---------- helpers ----------
def clamp(x, lo, hi): return max(lo, min(hi, x))
def rr(x, n): return round(float(x), n)

def valid_inputs(w,h,ft,bt,rt):
    if w is None or h is None:                return False, "missing size"
    if w <= 0 or h <= 0:                      return False, "non-positive size"
    if ft is None or bt is None or rt is None:return False, "missing thickness"
    if ft < 0 or bt < 0 or rt < 0:            return False, "negative thickness"
    if 2*ft >= min(w,h):                      return False, "frame too thick"
    return True, ""

def make_rect_xy(cx, cy, ww, hh):
    rx = rg.Interval(cx-ww/2.0, cx+ww/2.0)
    ry = rg.Interval(cy-hh/2.0, cy+hh/2.0)
    return rg.Rectangle3d(rg.Plane.WorldXY, rx, ry).ToNurbsCurve()

def xform_to_face(curves, face_plane, theta_deg):
    # rotate in local XY by theta, then orient XY->face_plane
    rot = rg.Transform.Rotation(math.radians(float(theta_deg)), rg.Point3d(0,0,0))
    xform = rg.Transform.PlaneToPlane(rg.Plane.WorldXY, face_plane)
    out=[]
    for c in curves:
        cc = c.DuplicateCurve()
        cc.Transform(rot); cc.Transform(xform)
        out.append(cc)
    return out

# ---------- read / sanitize inputs ----------
w   = float(tile_w)
h   = float(tile_h)
ft  = float(frame_t)
bt  = float(bar_t)
rt  = float(ring_t)
aid = int(archetype_id)
cid = int(corner_id) % 4
th  = float(theta_deg)

# defaults so outputs are always defined
preview = []
panel_area_m2 = 0.0
cut_length_m  = 0.0
void_ratio    = 1.0
is_valid      = False
signature_raw = ""

ok, msg = valid_inputs(w,h,ft,bt,rt)

if ok:
    # ---------- base numbers (cm) ----------
    outer_perim = 2.0*(w+h)
    inner_w = w - 2.0*ft
    inner_h = h - 2.0*ft
    inner_perim = 2.0*(inner_w + inner_h)
    rect_area = w*h
    built_area = 0.0
    ring_cut = 0.0

    # ---------- archetypes ----------
    if aid == 0:  # SOLID
        built_area = rect_area
        cut_len_cm = outer_perim
        preview += xform_to_face([ make_rect_xy(0,0,w,h) ], face_plane, th)

    elif aid == 2:  # DIAMOND (+): frame + horizontal + vertical bars
        a = max(0.0, inner_w); b = max(0.0, inner_h)
        built_area = rect_area - (inner_w*inner_h)                   # frame
        bars_area  = max(0.0, a*bt + b*bt - bt*bt)                   # two bars minus overlap
        built_area += bars_area
        cut_len_cm = outer_perim + inner_perim + 2*(2*(a+bt) + 2*(b+bt))
        preview += xform_to_face([
            make_rect_xy(0,0,w,h),
            make_rect_xy(0,0,inner_w,inner_h),
            make_rect_xy(0,0,a,bt),
            make_rect_xy(0,0,bt,b)
        ], face_plane, th)

    elif aid == 1:  # CROSS (X): frame + 2 diagonal bars
        a = max(0.0, min(inner_w, inner_h))
        diag = math.sqrt(2.0)*a
        built_area = rect_area - (inner_w*inner_h)
        bars_area  = max(0.0, 2.0*diag*bt - bt*bt)
        built_area += bars_area
        cut_len_cm = outer_perim + inner_perim + 2*(2*(diag+bt))
        r1 = make_rect_xy(0,0,diag,bt); r2 = make_rect_xy(0,0,diag,bt)
        r1.Transform(rg.Transform.Rotation(math.radians(45),  rg.Point3d(0,0,0)))
        r2.Transform(rg.Transform.Rotation(math.radians(-45), rg.Point3d(0,0,0)))
        preview += xform_to_face([
            make_rect_xy(0,0,w,h),
            make_rect_xy(0,0,inner_w,inner_h),
            r1, r2
        ], face_plane, th)

    elif aid == 3:  # QUARTER-RING: frame + annulus quarter at corner
        built_area = rect_area - (inner_w*inner_h)
        a = min(inner_w, inner_h)
        if a > 0:
            R = a/2.0
            rt = clamp(rt, 0.0, R-0.01)
            r_in = R - rt
            ring_area = 0.25 * math.pi * (R*R - r_in*r_in)
            ring_cut  = (math.pi/2.0)*(R + r_in) + 2.0*rt
            built_area += ring_area
        cut_len_cm = outer_perim + inner_perim + ring_cut
        # preview: outer + inner + ring edges
        sx = -1 if (cid in (0,3)) else +1
        sy = -1 if (cid in (0,1)) else +1
        cx = sx*(inner_w/2.0); cy = sy*(inner_h/2.0)
        crvs = [ make_rect_xy(0,0,w,h), make_rect_xy(0,0,inner_w,inner_h) ]
        if a > 0 and rt > 0:
            arc_outer = rg.Arc(rg.Circle(rg.Point3d(cx,cy,0), R), math.pi/2.0).ToNurbsCurve()
            arc_inner = rg.Arc(rg.Circle(rg.Point3d(cx,cy,0), R-rt), math.pi/2.0).ToNurbsCurve()
            p1 = rg.Point3d(cx+sx*R, cy, 0);     p2 = rg.Point3d(cx+sx*(R-rt), cy, 0)
            p3 = rg.Point3d(cx, cy+sy*R, 0);     p4 = rg.Point3d(cx, cy+sy*(R-rt), 0)
            rad1 = rg.Line(p1,p2).ToNurbsCurve(); rad2 = rg.Line(p3,p4).ToNurbsCurve()
            crvs += [arc_outer, arc_inner, rad1, rad2]
        preview += xform_to_face(crvs, face_plane, th)

    else:
        # Fallback → Solid
        built_area = rect_area
        cut_len_cm = outer_perim
        preview += xform_to_face([ make_rect_xy(0,0,w,h) ], face_plane, th)

    # ---------- metrics ----------
    panel_area_m2 = built_area / 10000.0     # cm² → m²
    cut_length_m  = cut_len_cm / 100.0       # cm  → m
    void_ratio    = max(0.0, min(1.0, 1.0 - (built_area / rect_area)))

    is_valid = True
    if inner_w <= 0 or inner_h <= 0:                             is_valid = False
    if aid in (1,2) and bt <= 0:                                 is_valid = False
    if aid == 3 and (rt <= 0 or rt >= min(inner_w,inner_h)/2.0): is_valid = False

    signature_raw = "{}|{}|{}|{}|{}|{}|{}|{}".format(
        aid, rr(w,1), rr(h,1), rr(ft,1), rr(bt,1), rr(rt,1), cid, rr(th,1)
    )
else:
    # invalid inputs → keep defaults (zeros) and empty preview/signature
    pass

# ---------- pack JSON & set outputs ----------
data = {
    "is_valid": bool(is_valid),
    "panel_area": float(rr(panel_area_m2, 4)),
    "cut_length": float(rr(cut_length_m, 4)),
    "void_ratio": float(rr(void_ratio, 4)),
    "fold_count": 0,
    "signature_raw": signature_raw
}
metrics_json = json.dumps(data)
preview_crv  = preview
# ---------- end python_3_script_4 ----------

panel_2 = Panel(python_3_script_3.tile_ctx_json)  # disabled
panel_3 = Panel(python_3_script_4.signature_raw)

# ----
# Grouping panels
# Area with side length
# Perimeter
facade_panels = Curve(python_3_script.outlines)  # disabled
explode = Explode(Curve=facade_panels, Recursive=True)  # -> Segments, Vertices
join_curves = JoinCurves(Curves=explode.Segments, Preserve=False)  # -> flatten(Curves)
dimensions = Dimensions(Surface=join_curves)  # -> UDimension, VDimension
area_3 = Area(Geometry=facade_panels)  # -> Area, Centroid
areapanels = Data(area_3.Area)
u_dim = Data(dimensions.UDimension)
v_dim = Data(dimensions.VDimension)
expression = Expression(x=v_dim, y=u_dim, Expression="(x+y)*2")
expression_2 = Expression(x=areapanels, y=v_dim, z=u_dim, Expression="x+(y+z)")
panelperimetersides = Data(expression)
panelareasides = Data(expression_2)

rectangle = Rectangle(Plane=PlaneXY(0, 0, 0), XSize=Slider(5, range=0..5), YSize=Slider(5, range=0..5), Radius=0)  # -> Rectangle, Length

# ----
# Grouping panels
# Area with side length
# Perimeter
facade_panels_2 = Curve(python_3_script_4.preview_crv)  # disabled
explode_2 = Explode(Curve=facade_panels_2, Recursive=True)  # -> Segments, Vertices; disabled
join_curves_2 = JoinCurves(Curves=explode_2.Segments, Preserve=False)  # -> flatten(Curves); disabled
dimensions_2 = Dimensions(Surface=join_curves_2)  # -> UDimension, VDimension; disabled
area_4 = Area(Geometry=facade_panels_2)  # -> Area, Centroid; disabled
areapanels_2 = Data(area_4.Area)  # disabled
u_dim_2 = Data(dimensions_2.UDimension)  # disabled
v_dim_2 = Data(dimensions_2.VDimension)  # disabled
expression_3 = Expression(x=v_dim_2, y=u_dim_2, Expression="(x+y)*2")  # disabled
expression_4 = Expression(x=areapanels_2, y=v_dim_2, z=u_dim_2, Expression="x+(y+z)")  # disabled
panelperimetersides_2 = Data(expression_3)  # disabled
panelareasides_2 = Data(expression_4)  # disabled

project = Project(Polyline=python_3_script.outlines)  # -> Polyline, Plane

# ----
# CNC program ≈ 60–120; small mold/jig ≈ 150–300; complex mold ≈ 300–450
number_slider_9 = Slider(60, range=60..450)  # disabled

# ----
# Notes
# Budget >> 40–70 (precast/GRC) Mid >> 70–110 (aluminum/steel)>> High >> 110–180 (terracotta, premium finishes)
number_slider_10 = Slider(40, range=35..180)  # disabled

# ----
# Laser steel/alum ≈ 1–3; waterjet stone ≈ 2–6
number_slider_11 = Slider(1, range=0.8..6)  # disabled

# ----
# Stricter QC / more unique panels → higher waste
number_slider_12 = Slider(1.08, range=1.03..1.15)  # disabled

# ----
# Smaller K = more reuse, cheaper production
number_slider_13 = Slider(3, range=3..12)  # disabled

# ----
# Panel size in cm
number_slider_14 = Slider(500, range=0..1000)  # disabled
number_slider_15 = Slider(300, range=0..1000)  # disabled
rectangle_2 = Rectangle(Plane=PlaneXY(0, 0, 0), XSize=number_slider_14, YSize=number_slider_15, Radius=0)  # -> Rectangle, Length; disabled

pack_objects = PackObjects(Geo=python_3_script.outlines, Plane=project.Plane, X=1, Y=1, Tolerance=0)  # -> Geo, Transformation

number_slider_16 = Slider(4, range=0..360)  # disabled
number_slider_17 = Slider(0, range=0..5.01)  # disabled
number_slider_18 = Slider(0, range=0..2)  # disabled
number_slider_19 = Slider(0, range=0..100)  # disabled
number_slider_20 = Slider(30, range=0..100)  # disabled
number_slider_21 = Slider(1, range=0.01..10)  # disabled
number_slider_22 = Slider(10, range=1..100)  # disabled
number_slider_23 = Slider(10000, range=1..100000)  # disabled
number_slider_24 = Slider(0, range=0..120)  # disabled
panel_4 = Panel("MecSoft_Font-1 -10")  # disabled
options = Options(
    Rotations=number_slider_16,
    Wiggle=number_slider_17,
    PlacementType=number_slider_18,
    Spacing=number_slider_19,
    Seed=number_slider_20,
    SimplifyTolerance=number_slider_21,
    Mutation=number_slider_22,
    Population=number_slider_23,
    Time=number_slider_24,
    SheetFont=panel_4)  # disabled

# ----
# NESTING
python_3_script_5 = Python3Script(preview_crv=python_3_script_4.preview_crv, signature_raw=python_3_script_4.signature_raw)  # -> out, proto_crv, proto_label, proto_count, tile_to_proto, expanded_idx; inputs preview_crv: list, signature_raw: list; disabled
# ---------- python_3_script_5: Python ----------
import Rhino.Geometry as rg
import System
import scriptcontext as sc
from collections import OrderedDict

# --- helpers ---
def as_list(x):
    if x is None: return []
    if isinstance(x, (list, tuple)): return list(x)
    return [x]

def coerce_curve(obj):
    """Accept Curve/PolylineCurve/Guid; return an rg.Curve or None."""
    if isinstance(obj, rg.Curve):
        return obj.DuplicateCurve()
    # Polyline to curve
    if isinstance(obj, rg.Polyline):
        return obj.ToNurbsCurve()
    # Guid from Rhino doc
    if isinstance(obj, System.Guid):
        rh = sc.doc.Objects.Find(obj)
        if rh: 
            geo = rh.Geometry
            if isinstance(geo, rg.Curve): 
                return geo.DuplicateCurve()
    return None

def clean_curve(c):
    if c is None: return None
    c = c.DuplicateCurve()
    # planarize if needed
    if not c.IsPlanar():
        ok, pl = c.TryGetPlane(1e-6)
        if ok:
            c = rg.Curve.ProjectToPlane(c, pl)
    # close & simplify
    try: c.MakeClosed(1e-6)
    except: pass
    c = c.Simplify(rg.CurveSimplifyOptions.All, 1e-3, 1e-3) or c
    return c

# --- read inputs robustly ---
curves = [coerce_curve(x) for x in as_list(preview_crv)]
sigs   = [str(s) for s in as_list(signature_raw)]

n = min(len(curves), len(sigs))
curves = curves[:n]
sigs   = sigs[:n]

# --- group by signature ---
groups = OrderedDict()         # sig -> {"idx":int, "curves":[curve,...]}
tile_to_proto = []

for i in range(n):
    sig = sigs[i]
    if sig not in groups:
        groups[sig] = {"idx": len(groups), "curves": []}
    groups[sig]["curves"].append(curves[i])
    tile_to_proto.append(groups[sig]["idx"])

# --- representative curve per proto (first usable), counts, labels ---
proto_label, proto_crv, proto_count = [], [], []
expanded_idx = []   # order for expanded quantities (one per part)

for sig, g in groups.items():
    rep = None
    for c in g["curves"]:
        rep = clean_curve(c)
        if rep: break
    if rep is None:
        # fallback tiny circle to keep index alignment
        rep = rg.Circle(rg.Point3d(0,0,0), 0.001).ToNurbsCurve()
    proto_label.append(sig)
    proto_crv.append(rep)
    cnt = len(g["curves"])
    proto_count.append(cnt)
    # if you need an expanded order (one entry per part)
    expanded_idx.extend([g["idx"]]*cnt)
# ---------- end python_3_script_5 ----------
boolean_toggle = BooleanToggle(True)  # disabled
boolean_toggle_2 = BooleanToggle(False)  # disabled
geometry = Geometry(
    Outlines=python_3_script_5.proto_crv,
    Simplify=boolean_toggle,
    Hull=boolean_toggle_2,
    Copies=python_3_script_5.proto_count)  # -> Geometry, Borders; disabled
boolean_toggle_3 = BooleanToggle(True)  # disabled
sheets = Sheets(Polylines=rectangle_2.Rectangle, Gap=0.1)  # -> Sheets, Polylines; disabled
opennest2 = OpenNest2(Sheets=sheets.Sheets, Geometry=geometry.Geometry, Options=options, Iterations=1, Run=boolean_toggle_3)  # -> Sheets, flatten(Borders), AllGeo, Transforms, SheetId, SheetTxt, Attributes; disabled

python_3_script_6 = Python3Script(
    metrics_json_list=python_3_script_4.metrics_json,
    material_per_m2=number_slider_10,
    cut_per_m=number_slider_11,
    waste_factor=number_slider_12,
    setup_cost=number_slider_9,
    K=number_slider_13)  # -> out, is_valid, area, cut_len, void_ratio, signature, panel_cost, proto_status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; disabled
# ---------- python_3_script_6: Python ----------
import json

# ------- helpers -------
def flatten(xs):
    if xs is None:
        return []
    # strings are iterable; treat as leaf
    if isinstance(xs, (str, bytes, dict)):
        return [xs]
    try:
        it = iter(xs)
    except TypeError:
        return [xs]
    out = []
    for x in it:
        out.extend(flatten(x))
    return out

def parse_metric(x):
    # accept dict or JSON string; return dict or None
    if x is None:
        return None
    if isinstance(x, dict):
        return x
    if isinstance(x, (str, bytes)):
        s = x.strip()
        if not s:
            return None
        try:
            d = json.loads(s)
            return d if isinstance(d, dict) else None
        except:
            return None
    return None

# ------- read & sanitize -------
raw = flatten(metrics_json_list)
ms = []
for x in raw:
    d = parse_metric(x)
    if d and "is_valid" in d:
        ms.append(d)
    # silently skip empties/invalid parses

# if nothing parsed, return safe empties
if not ms:
    is_valid, area, cut_len, void_ratio, signature = [], [], [], [], []
    panel_cost, proto_status = [], []
    total_cost, unique_protos, proto_labels = 0.0, 0, []
else:
    # expose raw metrics
    is_valid   = [bool(m.get("is_valid", False)) for m in ms]
    area       = [float(m.get("panel_area", 0.0)) for m in ms]
    cut_len    = [float(m.get("cut_length", 0.0)) for m in ms]
    void_ratio = [float(m.get("void_ratio", 0.0)) for m in ms]
    signature  = [str(m.get("signature_raw","")) for m in ms]

    # ---- prototype clustering with cap K ----
    K = max(1, int(K))
    proto_order = []      # first-use order
    proto_map   = {}      # signature -> canonical label
    proto_status = []

    for sig in signature:
        if sig in proto_map:
            proto_status.append("reuse")
            continue
        if sig and len(proto_order) < K:
            proto_order.append(sig)
            proto_map[sig] = sig
            proto_status.append("new")
        else:
            # bank full or empty signature -> force to first if available
            if proto_order:
                proto_map[sig] = proto_order[0]
            proto_status.append("forced")

    # counts per canonical prototype
    counts = {}
    for sig in signature:
        canon = proto_map.get(sig, sig)
        counts[canon] = counts.get(canon, 0) + 1

    # ---- cost model ----
    mp2  = float(material_per_m2)
    cpm  = float(cut_per_m)
    wf   = float(waste_factor)
    sc   = float(setup_cost)

    panel_cost = []
    for ok, a, L, sig in zip(is_valid, area, cut_len, signature):
        if not ok:
            panel_cost.append(1e9)
            continue
        base  = a * mp2 * wf + L * cpm
        canon = proto_map.get(sig, sig)
        share = sc / max(1, counts.get(canon, 1)) if canon else 0.0
        panel_cost.append(base + share)

    total_cost    = sum(panel_cost)
    unique_protos = len(proto_order)
    proto_labels  = list(proto_order)
# ---------- end python_3_script_6 ----------

is_valid = Panel(python_3_script_6.is_valid)  # disabled
area_5 = Panel(python_3_script_6.area)  # disabled
cut_len = Panel(python_3_script_6.cut_len)  # disabled
void_ratio = Panel(python_3_script_6.void_ratio)  # disabled
signature = Panel(python_3_script_6.signature)  # disabled
panel_cost = Panel(python_3_script_6.panel_cost)  # disabled
proto_status = Panel(python_3_script_6.proto_status)  # disabled
total_cost = Panel(python_3_script_6.total_cost)  # disabled
unique_protos = Panel(python_3_script_6.unique_protos)  # disabled
proto_labels = Panel(python_3_script_6.proto_labels)  # disabled

options_2 = Options(
    Rotations=Slider(4, range=0..360),
    Wiggle=Slider(0, range=0..5.01),
    PlacementType=Slider(0, range=0..2),
    Spacing=Slider(0, range=0..100),
    Seed=Slider(30, range=0..100),
    SimplifyTolerance=Slider(1, range=0.01..10),
    Mutation=Slider(10, range=1..100),
    Population=Slider(10000, range=1..100000),
    Time=Slider(0, range=0..120),
    SheetFont="MecSoft_Font-1 -10")

geometry_2 = Geometry(Outlines=pack_objects.Geo, Simplify=Toggle(True), Hull=Toggle(False))  # -> Geometry, Borders

# ----
# NESTING
sheets_2 = Sheets(Polylines=rectangle.Rectangle, Gap=0.1)  # -> Sheets, Polylines
opennest2_2 = OpenNest2(Sheets=sheets_2.Sheets, Geometry=geometry_2.Geometry, Options=options_2, Iterations=1, Run=Toggle(True))  # -> Sheets, flatten(Borders), AllGeo, Transforms, SheetId, SheetTxt, Attributes; disabled

# ----
# Group panels based on dimentions
create_set = CreateSet(List=panelareasides)  # -> Set, Map
area_with_length_of_groups = Panel(create_set.Map)
member_index = MemberIndex(Set=panelareasides, Member=create_set.Set)  # -> Index, Count
mappanelgroups = Data(create_set.Map)
nr_of_panels_per_group = Panel(member_index.Count)
indexpanelgroups = Data(member_index.Index)
countpanelgroups = Data(member_index.Count)

# ----
# Visualise
mappanelgroups_2 = Data(mappanelgroups)
bounds = Bounds(Numbers=mappanelgroups_2)
deconstruct_domain = DeconstructDomain(Domain=bounds)  # -> Start, End
gradient = Gradient(
    LowerLimit=deconstruct_domain.Start,
    UpperLimit=deconstruct_domain.End,
    Parameter=mappanelgroups_2,
    stops=[0: RGB(243, 57, 0), 0: RGB(236, 27, 60), 0.111: RGB(210, 0, 118), 0.223: RGB(103, 0, 120), 0.36: RGB(39, 72, 161), 0.484: RGB(1, 192, 229), 0.618: RGB(18, 178, 90), 0.729: RGB(79, 186, 8), 0.842: RGB(220, 237, 32), 1: RGB(243, 57, 0), 1: RGB(247, 159, 20)])
panels = Surface(facade_panels)
custom_preview = CustomPreview(Geometry=panels, Material=gradient)

# ----
# Group panels based on dimentions
create_set_2 = CreateSet(List=panelareasides_2)  # -> Set, Map; disabled
area_with_length_of_groups_2 = Panel(create_set_2.Map)  # disabled
member_index_2 = MemberIndex(Set=panelareasides_2, Member=create_set_2.Set)  # -> Index, Count; disabled
mappanelgroups_3 = Data(create_set_2.Map)  # disabled
nr_of_panels_per_group_2 = Panel(member_index_2.Count)  # disabled
indexpanelgroups_2 = Data(member_index_2.Index)  # disabled
countpanelgroups_2 = Data(member_index_2.Count)  # disabled

# ----
# Visualise
mappanelgroups_4 = Data(mappanelgroups_3)  # disabled
bounds_2 = Bounds(Numbers=mappanelgroups_4)  # disabled
deconstruct_domain_2 = DeconstructDomain(Domain=bounds_2)  # -> Start, End; disabled
gradient_2 = Gradient(
    LowerLimit=deconstruct_domain_2.Start,
    UpperLimit=deconstruct_domain_2.End,
    Parameter=mappanelgroups_4,
    stops=[0: RGB(243, 57, 0), 0: RGB(236, 27, 60), 0.111: RGB(210, 0, 118), 0.223: RGB(103, 0, 120), 0.36: RGB(39, 72, 161), 0.484: RGB(1, 192, 229), 0.618: RGB(18, 178, 90), 0.729: RGB(79, 186, 8), 0.842: RGB(220, 237, 32), 1: RGB(243, 57, 0), 1: RGB(247, 159, 20)])  # disabled
panels_2 = Surface(facade_panels_2)  # disabled
custom_preview_2 = CustomPreview(Geometry=panels_2, Material=gradient_2)  # disabled

# ----
# COST CALCULATOR
length = Length(Curve=opennest2.Borders)  # disabled
sheet = Curve(opennest2.Sheets)  # disabled
area_6 = Area(Geometry=sheet)  # -> Area, Centroid; disabled
panel_5 = Panel("10000")  # disabled
panel_6 = Panel("10000")  # disabled
division = Division(A=area_6.Area, B=panel_5)  # disabled
division_2 = Division(A=length, B=panel_6)  # disabled
fabrication_cost_per_m = Panel("30")  # disabled
cost_per_m2 = Panel("30")  # disabled
integer = Integer(division)  # disabled
multiplication = Multiplication(A=integer, B=cost_per_m2)  # disabled
multiplication_2 = Multiplication(A=division_2, B=fabrication_cost_per_m)  # -> flatten(Result); disabled
mass_addition = MassAddition(Input=multiplication)  # -> Result, PartialResults; disabled
mass_addition_2 = MassAddition(Input=multiplication_2)  # -> Result, PartialResults; disabled
addition = Addition(A=mass_addition.Result, B=mass_addition_2.Result)  # disabled
total_cost_2 = Panel(addition)  # disabled

# ----
# COST CALCULATOR
length_2 = Length(Curve=opennest2_2.Borders)
sheet_2 = Curve(opennest2_2.Sheets)
area_7 = Area(Geometry=sheet_2)  # -> Area, Centroid
division_3 = Division(A=area_7.Area, B="100")
division_4 = Division(A=length_2, B="100")
fabrication_cost_per_m_2 = Panel("30")
cost_per_m2_2 = Panel("30")
integer_2 = Integer(division_3)
multiplication_3 = Multiplication(A=integer_2, B=cost_per_m2_2)
multiplication_4 = Multiplication(A=division_4, B=fabrication_cost_per_m_2)  # -> flatten(Result)
mass_addition_3 = MassAddition(Input=multiplication_3)  # -> Result, PartialResults
mass_addition_4 = MassAddition(Input=multiplication_4)  # -> Result, PartialResults
addition_2 = Addition(A=mass_addition_3.Result, B=mass_addition_4.Result)
total_cost_3 = Panel(addition_2)
context_bake = ContextBake(Paneling_Cost_Reward=addition_2)

panel_7 = Panel(division_3)
